# Grasshopper definition readme_component.gh (Grasshopper 1.0.7)

readme_getter = GhPythonScript()  # -> out, a
# ---------- readme_getter: Python ----------
import os

from ghpythonlib.componentbase import executingcomponent as component
import Grasshopper, GhPython
import System
import Rhino
import rhinoscriptsyntax as rs

def text_file_to_str(file, extra_new_line_char = '', encoding = 'utf-8'):
    #type(str, str) -> str
    """ A simple text file reader.  """
    if file is None or not isinstance(file, basestring):
        msg = 'file == %s is not a string' % file
        logger.error(msg)
        raise TypeError(msg)
    elif not os.path.isfile(file):
        msg = 'file == %s is not a file path' % file
        logger.error(msg)
        raise ValueError(msg)
    else:
        with open(file, 'rb') as f:
            file_contents = extra_new_line_char.join(line.decode(encoding)
                                                     for line in f
                                                    )
    return file_contents

class MyComponent(component):
    
    def RunScript(self, x, y):
        
        sDNA_GH_path = os.path.dirname(ghdoc.Path)
        
        README_md_path = os.path.join(sDNA_GH_path, 'README.md')
        if not os.path.isfile(README_md_path):
            README_md_path = os.path.join(os.path.dirname(sDNA_GH_path), 'README.md')
        # Readme.md is a level higher in the repo than in the sDNA_GH
        # folder in a user installation - it is moved intentionally
        # by create_release_sDNA_GH_zip.bat 
        readme = text_file_to_str(README_md_path)
        a = 'anything'
        
        doc = self.Attributes.Owner.OnPingDocument()
        readme_component = next(component 
                                for component in doc.Objects
                                if component.NickName == 'Readme.txt'
                               ) 
        
        readme_component.SetUserText(readme)
        
        return a
# ---------- end readme_getter ----------
readme_txt = Panel("""# sDNA_GH
sDNA is a world leading tool for Spatial Design Network Analysis.  sDNA_GH is a plug-in for Grasshopper providing components that run the tools from a local [sDNA](https://github.com/fiftysevendegreesofrad/sdna_open/releases) installation, on Rhino and Grasshopper geometry and data.  

## sDNA
sDNA is able to calculate Betweenness, Closeness, Angular distance, and many other quantities including custom hybrid metrics, and is able to perform many other advanced functions as well.  Please note, for results of a network analysis to be meaningful, it must be ensured that the network is first properly [prepared](https://sdna-open.readthedocs.io/en/latest/network_preparation.html).

## sDNA_GH functionality
sDNA_GH: 
 - Reads a network's polyline Geometry from Rhino or Grasshopper, and Data from any User Text on it. 
 - Writes the network polylines (formed by one or more polylines) and user Data to a Shapefile.  
 - Initiates an sDNA tool that processes that shapefile, and e.g. carries out a network preparation or an analysis.
 - Reads the shapefile produced by the sDNA tool.
 - Displays the results from sDNA by colouring a new layer of new polylines or the original ones.

## User manual.  
### System Requirements. 
#### Software
1. Windows 10 or 8.1 (not tested in Windows 11) 
2. Python 2.7.  Please note Iron Python 2.7 does not run sDNA correctly (as incorrect shapefiles are produced).
3. sDNA. 
4. Rhino and Grasshopper (tested in Rhino 7)
#### Hardware
1. 64-bit Intel or AMD processor (Not ARM) 
2. No more than 63 CPU Cores. 
3. 8 GB memory (RAM) or more is recommended. 
4. 1.2 GB disk space. 

### Installation.
1. Ensure you have an installation of [Rhino 3D](https://www.rhino3d.com/download/) including Grasshopper (versions 6 and 7 are supported).
2. Ensure you have an installation of [Python 2.7](http://www.python.org/ftp/python/2.7.3/python-2.7.3.msi) [^0]  that can run sDNA correctly from the command line.  sDNA_GH runs sDNA from the command line.  Command line use of sDNA has been tested with Python versions 2.6 and 2.7 .  Do not run sDNA with Iron Python 2.7, as invalid shape files may be produced (it is not possible to access the Iron Python shipped with Rhino from the command line, in any case).  
3. To use sDNA with sDNA_GH, ensure you have an installation of [sDNA](https://sdna-open.readthedocs.io/en/latest/installation_usage.html).  sDNA itself may require the 64 bit (x64) Visual Studio 2008 redistributable, available [here](https://docs.microsoft.com/en-us/cpp/windows/latest-supported-vc-redist?view=msvc-170#visual-studio-2008-vc-90-sp1-no-longer-supported) or [here](https://download.microsoft.com/download/5/D/8/5D8C65CB-C849-4025-8E95-C3966CAFD8AE/vcredist_x64.exe ) ).  The closed source "free as in beer" version of [sDNA](https://sdna.cardiff.ac.uk/sdna/software/software/) and sDNA+ may also require the 32 bit (x86) Visual Studio 2008 redistributable available or [here](https://docs.microsoft.com/en-us/cpp/windows/latest-supported-vc-redist?view=msvc-170#visual-studio-2008-vc-90-sp1-no-longer-supported) or [here](https://download.microsoft.com/download/5/D/8/5D8C65CB-C849-4025-8E95-C3966CAFD8AE/vcredist_x86.exe) in order to unlock sDNA with a serial number.
4. Download `sDNA_GH.zip` from [food4Rhino](https://www.food4rhino.com) or the [sDNA_GH releases page on Github](https://www.example.com).
5. Ensure `sDNA_GH.zip` is unblocked: Open File Explorer and go to your Downloads folder (or whichever folder you saved it in).  Right click it and select `Properties` from the bottom of the menu.  Then click on the _Unblock_ check box at the bottom (right of _Security_), then click `OK` or `Apply`.  The check box and _Security_ section should disappear.  This should unblock all the files in the zip archive.  If any files still need to be unblocked, a [PowerShell](https://docs.microsoft.com/en-us/powershell/scripting/install/installing-powershell) script is provided in the zip file: `\sDNA_GH\dev_tools\batch_files\unblock_all_files_powershell.bat`[^2]   Please do not automatically trust and unblock all software downloaded from anywhere on the internet [^1].  
6. Open Rhino and Grasshopper.
7. In Grasshopper's pull down menus (above the tabs ribbon at the top) click `File` -> `Special folders` -> `User Objects Folder`.  The default in Rhino 7 is `%appdata%\Grasshopper\UserObjects`.  Note, this is not the Components Folder used by many other plug-ins (i.e. not `%appdata%\Grasshopper\Libraries`).
8. Copy `sDNA_GH.zip` to this folder (e.g. it should be at `%appdata%\Grasshopper\UserObjects\sDNA_GH.zip`).
9. Unzip `sDNA_GH.zip` to this location (in Windows 10 right click `sDNA_GH.zip` and select `Extract All ...`, then click `Extract` to use the suggested location).  In the User Objects folder, a single subfolder called `sDNA_GH` should have been created.
10. Restart Rhino and Grasshopper.
11. The sDNA_GH plug in components should now be available under a new "sDNA" tab in the ribbon amongst the tabs for any other plug-ins installed (right of `Mesh`, `Intersect`, `Transform` and `Display` etc).  
12. To use sDNA with sDNA_GH, if no preferences are specified, sDNA_GH will search for sDNA and Python 2.7 installations automatically, using the first one of each it finds.  To ensure sDNA_GH uses a particular version of sDNA and the correct Python 2.7 interpreter it is recommended on first usage to:
    -place a Config component on the canvas (the component with a gear/cog icon in `Extra`).
    -Specify the file path of the sDNA folder (containing sDNAUISpec.py and runsdnacommand.py) of the sDNA installation you wish to use in the `sDNA_folders` input.
    -Specify the file path of the Python 2.7 interpreter's main executable in the `python` input.
    -Specify any other options you wish to save and reuse on all projects, if necessary by adding custom input Params with the option's name.
    -Connect a true boolean toggle to `go`.  An installation wide user options file (`config.toml`) will be created if there isn't one already.
    -To save options to other project specific `config.toml` files, specify the file path in `save_to` and repeat the previous 4 sub steps.

13. For a first test of sDNA_GH using sDNA, open  `\sDNA_GH\tests\5x18_random_grid_network.3dm` (in the previously unzipped folder in the User Objects folder), place an sDNA_Integral component and connect a true boolean toggle to its `go`.  
14. If a newer version of sDNA is used in future with tools unknown to sDNA_GH at the time it was built, if a Config component is placed, and the path of the new sDNA specified in `sDNA_folders`, sDNA_GH will attempt to automatically build components and user objects for the new sDNA tools, and add them to Grasshopper for you.  Set `make_new_comps` to false to prevent this.


### Usage.  
#### Components.
##### Automatic multi-tools.
Each sDNA tool has its own Grasshopper component.  To run a tool, a true value, e.g. from a Boolean toggle component, must be connected to its component's `go` Input Param [^note].  To group together common work flows, if an `auto_` option is set to true, some tools also automatically run other tools before or after they run themselves.  For example, this allows an entire sDNA process to be run on Rhino Geometry from a single sDNA tool component.  
When an sDNA_GH component is first placed on the canvas, or a grasshopper file with an sDNA_GH component on the canvas is first loaded, each component adds in Params for all its required Input and Output arguments (if the Params are not already present).  These added Params include those of any extra automatically added tools if an `auto_` option is true, that would other wise require separate components.  Extra customisation can be carried out by adding in user specified Params too, that have the correct name of a supported option.  Similarly any Params not being specified can be removed.  

[note] The Config component tool always loads its options when placed or its Inputs are updated for any value of `go`.  On the Unload_sDNA component, `unload` does the same thing as `go`.

##### Running individual tools.  
Multiple sDNA_GH components can be chained together to run in sequence by connecting the `OK` Output Param of one component, to the `go` Input Param of the component(s) to be run afterwards.  A Grasshopper Colour Gradient tool can be connected in between a Parse_Data component and Recolour_Objects component.  

##### Component Execution Order.
Multiple sDNA_GH tools can be run from a single sDNA_GH component by setting any of the `auto_` options to true: `auto_get_Geom`, `auto_read_User_Text`, `auto_write_Shp`, `auto_read_Shp` and `auto_plot_data`, on a Config component, before placing the chosen sDNA_GH tool on the canvas.    
**Warning!**   If you did not create a `config.toml` file (in Installation step 12 above), and if you rely instead on Config components inside your .gh file itself to set option values, immediately before saving your .gh file, be sure to select the Config component determining any `auto_` options, and press `Ctrl` + `B` (or from the pull-down menu select `Edit` -> `Arrange` -> `Put To Back`) to to send to the back, any components that should run first when you reload the .gh file.  This ensures the Config component will run before other sDNA_GH components, which rely on settings controlled by it to configure themselves correctly.

#### Options.  
sDNA_GH is highly customisable.  This customisation is controlled by setting options.  To give an option a value, connect a Grasshopper Param or text panel containing that value, to the Param with that option name on any sDNA_GH component (except Unload_sDNA).  If a Param is subsequently disconnected, its latest value will be remembered.  Some Text Params can be cleared by connecting an empty Text Panel to them.
Any option in a component can be read by adding an Output Param and renaming it to the name of the option.  Similarly, any option in a component can be changed by adding an Input Param and renaming it to the name of the option, and connecting it to the new value.  Entire options data structures (`opts`) may also be passed in from other sDNA_GH components as well, via normal Grasshopper connections. 

##### Adding Component Input and Output Params.  
To add a new Input or Output Param, zoom in on the component until plus and minus symbols can be seen between the params.  Click on the plus symbol where you want the new Param.  Right click the new Param's name (e.g. x, y or z for an Input Param, or a,b or c for an Output Param) to rename it to name of the desired option you wish to set.

##### Logging options
The logger is setup before Input Params are created on components, so to change the logging levels or to use a specific log file, `log_file_level`, `log_console_level`, `working_folder`, `logs_dir` or `log_file` must be set in an installation wide config.toml file, e.g. using a Config component.  Supported values for logging levels are: `DEBUG`, `INFO`, `WARNING`, `ERROR` and `CRITICAL`.
 
###### Options override priority order
1. The component input Param options override options in a project specific options file (`config`).  
2. A project specific options file (specified in `config`) overrides options from another sDNA_GH component (connected in `opts`).  
3. Options from another sDNA_GH component override the installation-wide options file (e.g. `%appdata%\Grasshopper\UserObjects\sDNA_GH\config.toml`).  
4. The installation-wide options file overrides the sDNA_GH hard-coded default options in `main.py` [^note]
[note] Dev note: the options in `main.py` themselves override every individual tool's default options in `tools.py`.

##### Local meta options.
By default all sDNA_GH components share (and may change) the same global `opts` (module options, tool options, and *meta* options) in the `main.py` module.  If only one of each tool is needed (and there is only one version of sDNA), that will suffice for most users.  

Advanced users may give sDNA_GH components different options to the others, by de-synchronising from the global options.  De-syncing occurs if a component's *local meta options* (`sync_to_module_opts`, `read_from_shared_global_opts`) are false.  *local metas* are like any other option, but shared using `l_metas` instead of `opts`, and not updated automatically from the main module options (as this would defeat their entire purpose).


#### Tools.
##### Common component input and output Params
**OK** This output is true when a component has executed successfully.
**go** Set this input to true (e.g. from a boolean toggle component) to run a component's tool.
**file** Specifies the path of a file to write to, or that was written to.
**Data**
`Data` must be a Data Tree 2 branches deep at the first level: a branch each for keys {0;0} and values {0;1}.  The two nodes of this structure should have a branch for each geometric object (so the nth's keys and values should have paths {0;0;n} and {0;1;n}).  The lists at these nodes must be of equal length.  The mth key and value of the nth geometric object should be {0;0;n}[m] and {0;1;n}[m] respectively.  Read_Shp supplies a Data Tree in this required format, if the data is read from User Text or from a Shapefile.  Grasshopper's path tools can be used to adjust compatible Data Trees into this format.  
**Geom** Accepts a list of geometric objects (Rhino or Grasshopper).  Data trees of objects need to be flattened into lists. 
**gdm** Accepts a Geometry-data-mapping, a python nested dictionary.  The keys are the UUIDs of geometric objects.  The values are also dictionaries, containing key/value pairs for use as User Text.
**opts** Accepts an options data structure (a nested dictionary of named tuples) from another sDNA_GH component.  Only of use if they are not synced to the global module options.
**config** The path of a TOML file (e.g. `config.toml`) to be read in containing sDNA_GH options settings. 

##### Support tools
###### Config (config)
To guarantee your components are setup correctly, this component must run before all others when your .gh file is loaded.  To ensure this, select it and press `Ctrl` + `B` (or from the pull-down menu select `Edit` -> `Arrange` -> `Put To Back`) before saving.

Loads custom user options and configuration files (`.toml`).  Saves options to a `.toml` file if go is true.  If a `.toml` file is specified in `save_to`, it is saved to.  Otherwise the default value of `save_to` is the installation-wide user options file.  One is created if it does not already exist.  This will overwrite existing files.


###### Read_Geom (get_Geom)
Reads in references to Rhino polylines to provide them in the required form for subsequent sDNA_GH tools.  Set the option `selected` to true, to only from objects that the user has selected.  Similarly, specify `layer` = your_layer_name to only read from a specific layer.  To go back to selecting all layers, set `layer` to any value that is not the name of a layer.

The UUIDs of Rhino objects are converted to strings to preserve the references to them.  


##### Shapefile tools
###### Write_Shp (write_shapefile)
Writes a DataTree in `Data` and a list of polylines in `Geom` to a shapefile.  If not specified in `file`, a default file name based on the Rhino doc or Grasshopper doc name is used (unless `auto_update_Rhino_doc_path = false`).  `overwrite_shp` = true overwrites existing files; false or creates new files up to a maximum of `max_new_files`.  **WARNING!  Shapefiles created with default names (due to no valid file path being specified in `file` by the user) will be deleted by subsequent sDNA tools if `strict_no_del` = false, `overwrite_shp` = false, and `del_after_sDNA` = true.**  To create a projection (.prj) file for the new shapefile, specify the path of an existing .prj file in `prj`.  If no Data is supplied and `auto_read_User_Text` is true, this tool will first call read_User_Text.  To work with sDNA, data records are only written to the Shapefile (associated with a shape corresponding to a Rhino / GH polyline) if its field matches the template string specified in `input_key_str`.  The field name has a maximum of 10 characters long, and is taken from the `{name}` value (in the key name if it originated as User Text). To write all data with any key name (shorter then 11 characters) to the Shapefile, set `input_key_str` to `{name}`.


###### Read_Shp (read_shapefile)
Reads in polylines and associated data records from a shapefile of polylines.  Creates new objects if `new_geom` = true or no objects corresponding to the shapefile are specified in `Geom`.  Specify the path of the .shp file to read in `file`.  **WARNING!  If a valid file path was not specified in `file` on a preceding Write_Shp component, and that file was used by an sDNA tool, Read_Shp deletes sDNA output shapefiles with default names if `strict_no_del` = false, `overwrite_shp` = false, and `del_after_read` = true.**  If a list of existing geometry is provided in `Geom` that corresponds to (is the same length as) the data records in the shapefile, and if new_geom = false, only the data is read from the shapefile.  Otherwise the polylines in the shapefile are added as new Rhino Polyline objects if bake = true; otherwise as Grasshopper Polyline objects.  The bounding box output `bbox` is provided to create a legend frame within Recolour_Objects (its value is calculated from the shape file).  The abbreviations and field names from an sDNA results field file (if a file with the same name ending in .names.csv exists) are also read in, and supplied on `abbrevs` so that a drop-down list may be created, for easy selection of the data field for subsequent parsing and plotting.  If no separate Recolour_Objects Component is detected connected to the component's outputs downstream and `auto_plot_data = true`, Recolour_Objects is called afterwards.  


##### Plotting tools
###### Parse_Data (parse_data)
Parse the data in a Data Tree of numerical data (in `Data`) from a specified `field`, for subsequent colouring and plotting.  Be sure to supply the list of the data's associated geometric objects (in `Geom`), as legend tags and parsed values are appended to the output `Data` list and `Geom` list.  Some classifiers sort the data into ascending order (if supplied, the geometry objects will then be reordered too, preserving their correspondence).  To force a sort, according to `field` regardless, set `sort_data` to true.  To make each parsed data point, take the same value as its class midpoint, set `colour_as_class` to true.  Use this component separately from Recolour_Objects to calculate colours with a visible Grasshopper Colour Gradient component.  Max and Min bounds can be overridden (in `plot_max` and `plot_min`).  
**WARNING!  Parsing is for the purpose of colourisation, e.g. in order to produce the desired result from Recolour_Objects.  Therefore, although the inputted Data is not changed, the Data outputted almost certainly will be changed, so should be assumed to be false.**  
After parsing, the legend tags are the definitive reference for what each colour means, not the outputted data values. In particular, if `colour_as_class` = true, the parsed data will take far fewer distinct values than the number of polylines in a large network.  To parse numerical data that uses a numerical format different to your system's normal setting (e.g. with a different radix character: ',' or '.' or thousands separator: ',' or '_'), set `locale` to the corresponding IETF RFC1766,  ISO 3166 Alpha-2 code (e.g. `fr`, `cn`, `pl`).  


**Field to plot**
Specify the actual numeric data values to be parsed from all the provided 'User Text values' by setting `field` to the name of the corresponding 'User Text key'.  Valid `field` values for sDNA output shapefiles are in `fields`.  

**Bounds**
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""")
