# Grasshopper definition sDNA_build_components.gh (Grasshopper 1.0.8)

# .shp
# Analysis
# Calibration
# Data
# Dev
panel = Panel("C:\Users\drjam\Coding\venvs\sDNA\Lib\site-packages\sDNA")
# Leave Go to True to use batch file component builder.
# Edit this file with Disable Solver set.
path = FilePath("C:\Users\drjam\Coding\repos\sDNA_GH\src\sDNA_GH\launcher.py")
panel_2 = Panel("""#! /usr/bin/awk NR==3
# -*- coding: utf-8 -*-
# This module requires Grasshopper Python (Rhino3D)

# MIT License

# Copyright (c) [2021] [Cardiff University, a body incorporated
# by Royal Charter and a registered charity (number:
# 1136855) whose administrative offices are at 7th floor 30-
# 36 Newport Road, University CF24 0DE, Wales, UK]

# Permission is hereby granted, free of charge, to any person obtaining a copy
# of this software and associated documentation files (the "Software"), to deal
# in the Software without restriction, including without limitation the rights
# to use, copy, modify, merge, publish, distribute, sublicense, and/or sell
# copies of the Software, and to permit persons to whom the Software is
# furnished to do so, subject to the following conditions:

# The above copyright notice and this permission notice shall be included in all
# copies or substantial portions of the Software.

# THE SOFTWARE IS PROVIDED "AS IS", WITHOUT WARRANTY OF ANY KIND, EXPRESS OR
# IMPLIED, INCLUDING BUT NOT LIMITED TO THE WARRANTIES OF MERCHANTABILITY,
# FITNESS FOR A PARTICULAR PURPOSE AND NONINFRINGEMENT. IN NO EVENT SHALL THE
# AUTHORS OR COPYRIGHT HOLDERS BE LIABLE FOR ANY CLAIM, DAMAGES OR OTHER
# LIABILITY, WHETHER IN AN ACTION OF CONTRACT, TORT OR OTHERWISE, ARISING FROM,
# OUT OF OR IN CONNECTION WITH THE SOFTWARE OR THE USE OR OTHER DEALINGS IN THE
# SOFTWARE.



\"\"\" Main entry point to launch sDNA_GH if run as a script from an sDNA_GH GhPython component.

    Imports the python package sDNA_GH and (re)defining the MyComponent(component) 
    class.  Grasshopper instantiates this class in each such component, then 
    calls its RunScript method 
    (and recalls it on each Param update / recalculation).

    There may be multiple components, all running this same launcher code.
    Therefore we want the root logger to live in the sDNA_GH.main module
    that they each import.  The logging system is configurable by the user,
    but only through the options that are read in during the main package
    import, and we want to create logs before this too, in this module.  So 
    before a component has imported sDNA_GH.main, logging is routed through output, 
    a callable instance of Output, with a cache, defined below.  After a logger has 
    been set up according to the user's configuration, after the main package import,
    output's cache is flushed through the normal logging system, 

    Also, the Output class is used to define two Classes from this single 
    code definition.  Python scripts can happily import themselves, but here
    this is because launcher.py is itself part of the imported sDNA_GH python
    package, imported by launcher.py in a GhPythoncomponent.  To achieve this, the 
    code in this file needs to be copied into the sDNA_GH GhPython components 
    during building of the components (e.g. via the code input Param), 

    The behaviours can be different of course if changes are made to one and not
    the other. e.g. if updated code is forgotten to be copied into the component.

    A dummy MyComponent(component) class is defined in the script to appease
    GhPython's parser, even though the definition we use is imported from the package

    launcher.py can also run unittests in a component named "selftest" 
\"\"\"

__author__ = 'James Parrott'
__version__ = '0.04'



import sys
import os
import functools
import importlib

from ghpythonlib.componentbase import executingcomponent as component
import Grasshopper
import scriptcontext as sc

import_module = importlib.import_module
try:
    reload #type: ignore
except NameError:
    reload = importlib.reload

try:
    basestring #type: ignore
except NameError:
    basestring = str

try:
    ghdoc #type: ignore
except NameError:
    from .custom.skel.basic.ghdoc import ghdoc

package_name = 'sDNA_GH'
plug_in_name = 'sDNA'               
reload_already_imported = False
repo_folder = os.path.dirname( os.path.dirname(ghdoc.Path) ) if ghdoc.Path else None
user_install_folder = Grasshopper.Folders.DefaultUserObjectFolder




class Output(object): 

    def set_logger(self, logger, flush = True):
        self.logger = logger
        if flush and self.tmp_logs:
            self.flush()

    def __init__(self
                ,tmp_logs = None
                ,logger = None
                ):
        if not isinstance(tmp_logs, list): #assert not isinstance(None, list)
            tmp_logs = []
        self.tmp_logs = tmp_logs
        self.set_logger(logger, flush = False)



    def store(self, message, logging_level):
        self.tmp_logs.append( (message, logging_level) )

    def __call__(self, message, logging_level = "INFO", logging_dict = {}):
        #type: (str, str, dict, list) -> str
        
        #logger.debug(s)

        if logging_dict == {} and self.logger is not None: 
            logging_dict = dict( DEBUG = self.logger.debug
                                ,INFO = self.logger.info
                                ,WARNING = self.logger.warning
                                ,ERROR = self.logger.error
                                ,CRITICAL = self.logger.critical
                                )

        logging_level = logging_level.upper()
        if logging_level in logging_dict:
            logging_dict[logging_level](message)
        else:
            self.store(message, logging_level)

        return '%s : %s ' % (logging_level, message)

    def __getattr__(self, attr):
        return functools.partial(self.__call__, logging_level = attr.upper())

    def flush(self):
        tmp_logs = self.tmp_logs[:] # __call__ might cache back to tmp_logs
        self.tmp_logs[:] = [] # Mutate list initialised with.  Avoid double 
                              # logging in case re - stored in tmp_logs
        for tmp_log_message, tmp_log_level in tmp_logs:
            self.__call__(tmp_log_message, tmp_log_level)

output = Output()


class InvalidArgsError(Exception):
    
    \"\"\"Custom exception to log the error message, and to at least allow 
       attempts to give users actionable advice to fix the issue, in 
       the event of a problem.  
    \"\"\"
    message_fmt = 'Invalid import args: %s'
    def __init__(self
                ,message_fmt = ''
                ,message = ''
                ,logger = output
                , **kwargs
                ):
        if message_fmt and isinstance(message_fmt, basestring):
            self.message_fmt = message_fmt
        if not message or not isinstance(message, basestring):
            message = self.message_fmt % kwargs
        logger.error(message)
        self.kwargs = kwargs
        super(Exception, self).__init__(message)    


class ModuleNameError(InvalidArgsError):
    message_fmt = 'Invalid module name: %s'


class FilePathError(InvalidArgsError):
    message_fmt = 'Invalid path to import module from: %s'


# We only know the sDNA version to import as a string.  This is more secure too.
def strict_import(module_name = ''
                 ,folder = ''
                 ,sub_folder = ''
                 ,logger = output
                 ,reload_already_imported = reload_already_imported
                 ):

    # type: (str, str, str, type[any], bool) -> type[any]
    \"\"\" Imports the named module from the specified folder\subfolder only, 
        and returns it.
        
        Avoids name clashes and casual hijack attempts.  In some 
        environments supporting a Python implementation (such as 
        GhPython in Grasshopper) it may not be desireable to ask the user 
        to set PYTHONPATH.  Hence here, we save sys.path to a tmp 
        variable, set sys.path to the specified folders, attempt the 
        import in a try: block, and restore sys.path in a finally: block
    \"\"\"
    if not module_name or not isinstance(module_name, basestring):
        raise ModuleNameError(module_name = module_name
                             ,folder = folder
                             ,sub_folder = sub_folder
                             ,logger = logger
                             )
    logger.debug(module_name)
    if module_name in sys.modules:   # sys.modules is also shared between GHPython components 
                                     # (and is even saved until Rhino is closed).
        logger.debug('Module %s already in sys.modules' % module_name)
        if reload_already_imported:
            logger.debug('Reloading %s.... ' % module_name)
            reload(sys.modules[module_name]) # type: ignore
        return sys.modules[module_name]
    #
    #
    # Load module_name for first time:
    #
    #
    search_path = os.path.join(folder, sub_folder)

    if (search_path 
        and isinstance(search_path, basestring) 
        and os.path.isdir(search_path)):
        #
        logger.debug('Search path == %s' % search_path)
        #if search_folder_only:
        #    sys.path = [search_path]
        if search_path not in sys.path:
            sys.path.insert(0, search_path)
    else:
        raise FilePathError(module_name = module_name
                           ,search_path = search_path
                           ,logger = logger
                           )

    logger.debug('Trying import... ')
    module = import_module(module_name, '')           

    return module       


class ModulesNotFoundError(InvalidArgsError):
    message_fmt = 'Modules not found in any location %s'


def load_modules(m_names
                ,folders
                ,logger = output
                ,module_name_error_msg = 'Please supply valid names of modules to import, %s'
                ,folders_error_msg = 'Please supply valid folders to import from. %s'
                ,modules_not_found_msg = 'Specified modules not found in any folder, %s'):
    #type(str/ Iterable, list, type[any], str, str) -> tuple / None
    \"\"\" Tries to import all modules in m_names, from the first folder in 
        folders to contain a .py or .pyc files with the same name as each 
        module.

        Returns a tuple of all the modules and the path they were found in.  Else 
        raises a ModulesNotFoundError.
    \"\"\"
    if not m_names or any( not isinstance(m_name, basestring) 
                               for m_name in m_names ):
        raise ModuleNameError(message_fmt = module_name_error_msg
                             ,m_names = m_names
                             ,logger = logger
                             )
    
    if isinstance(m_names, basestring):
        m_names = [m_names] 
    logger.debug('m_names == %s of type : %s' % (m_names, type(m_names).__name__))

    logger.debug('Testing paths : %s ' % folders)
    
    if isinstance(folders, basestring):
        folders = [folders]

    if not any(os.path.isdir(folder) or os.path.isdir(os.path.dirname(folder)) 
               for folder in folders
              ):
        raise FilePathError(message_fmt = folders_error_msg
                           ,m_names = m_names
                           ,logger = logger
                           )

    for folder in folders:
        logger.debug('Type(folder) : %s' % type(folder).__name__)
        logger.debug('Type(path) : %s path == %s' %(type(folder).__name__, folder))

        if os.path.isfile(folder):
            folder = os.path.dirname(folder)
        if all( any(os.path.isfile(os.path.join(folder, name.replace('.', os.sep) + ending)) 
                    for ending in ['.py','.pyc'] 
                   )
                for name in m_names
              ):
            #
            logger.debug('Importing %s' % repr(m_names))

            return tuple(strict_import(name, folder, '', logger = logger) 
                            for name in m_names
                        ) + (folder,)
            # tuple of modules, followed by the path to them
    raise ModulesNotFoundError(message_fmt = modules_not_found_msg
                              ,m_names = m_names
                              ,folders = folders
                              ,logger = logger
                              )




if __name__ == '__main__': # False in a compiled component.  But then the user
                           # can't add or remove Params to the component.  
    
    # Grasshopper will look for class MyComponent(component) in global scope
    # so a main function is a little tricky to define.

    nick_name = ghenv.Component.NickName #type: ignore

    if (repo_folder and 
        nick_name.replace(' ','').replace('_','').lower() == 'buildcomponents'):
        #
        sDNA_GH_search_paths = repo_folder 
        # builder can only load sDNA_GH from its parent directory, 
        # e.g. if in a dir one level up in the main repo
        # such as sDNA_build_components.gh.
    else:
        sDNA_GH_search_paths = user_install_folder


    sc.doc = ghdoc #type: ignore

    output.debug(sDNA_GH_search_paths)

    class sDNA_GH(object):
        pass

    if 'sDNA_GH.main' in sys.modules:
        sDNA_GH.main = sys.modules['sDNA_GH.main']
    else:
        sDNA_GH.main, _ = load_modules(m_names = package_name + '.main'
                                      ,folders = sDNA_GH_search_paths
                                      ,folders_error_msg = 'Please ensure a folder called %s' % package_name 
                                                          +' is created in '
                                                          +Grasshopper.Folders.DefaultUserObjectFolder                                                                    
                                                          +', containing main.py and all sDNA_GH python' 
                                                          +' files and subfolders. ' 
                                      ,modules_not_found_msg = 'Some sDNA_GH files may be missing.  Please copy'
                                                              +' sDNA_GH.zip into: '
                                                              +Grasshopper.Folders.DefaultUserObjectFolder
                                                              +', Unblock it if necessary, and then right click'
                                                              +' it and select Extract All... in that location. '
                                                              +' Ensure that main.py and all sDNA_GH python' 
                                                              +' files and subfolders are inside: '
                                                              +os.path.join(Grasshopper.Folders.DefaultUserObjectFolder
                                                                           ,package_name
                                                                           )
                                      )         


    logger = sDNA_GH.main.logger.getChild('launcher')
    output.set_logger(logger, flush = True)


    class MyComponent(component):
        pass  # Required.  Idiomatic to Grasshopper.  Must be called "MyComponent"  
            # too (it is looked for by the parser or scope checker?) otherwise 
            # Grasshopper may not find the subclass of on 
            # component.  Even though we overwrite this class on the next line
            # immediately below.  

    MyComponent = sDNA_GH.main.sDNA_GH_Component


    if nick_name.replace(' ','').replace('_','').lower() == 'selftest':  

        if sys.argv[0].endswith(os.path.join(package_name,'__main__.py')):   
            from .tests.unit_tests import unit_tests_sDNA_GH
        else:
            unit_tests_sDNA_GH, _ = load_modules('sDNA_GH.tests.unit_tests.unit_tests_sDNA_GH'
                                                ,sDNA_GH_search_paths
                                                )

        MyComponent._RunScript = MyComponent.RunScript
        MyComponent.RunScript = unit_tests_sDNA_GH.run_launcher_tests  """)
# Extra
# Geom
# Plot
# Preparation
button = Button()
sdna_gh = Text("sDNA_GH")
file = ReadFile(File=path, PerLineParse=False)
config = GhPythonScript(go=Button(), sDNA_paths=panel)  # -> out, OK, opts; inputs go: list, opts: list; disabled
#   port go: true: runs tools. false: do not run tools but still read other Params.
#   port opts: sDNA_GH options data structure. Python dictionary.
#   port OK: true: tools ran successfully. false: tools did not run, or there was an error.
#   port opts: sDNA_GH options data structure. Python dictionary.
# ---------- config: Python ----------
#! /usr/bin/awk NR==3
# -*- coding: utf-8 -*-
# This module requires Grasshopper Python (Rhino3D)

# MIT License

# Copyright (c) [2021] [Cardiff University, a body incorporated
# by Royal Charter and a registered charity (number:
# 1136855) whose administrative offices are at 7th floor 30-
# 36 Newport Road, University CF24 0DE, Wales, UK]

# Permission is hereby granted, free of charge, to any person obtaining a copy
# of this software and associated documentation files (the "Software"), to deal
# in the Software without restriction, including without limitation the rights
# to use, copy, modify, merge, publish, distribute, sublicense, and/or sell
# copies of the Software, and to permit persons to whom the Software is
# furnished to do so, subject to the following conditions:

# The above copyright notice and this permission notice shall be included in all
# copies or substantial portions of the Software.

# THE SOFTWARE IS PROVIDED "AS IS", WITHOUT WARRANTY OF ANY KIND, EXPRESS OR
# IMPLIED, INCLUDING BUT NOT LIMITED TO THE WARRANTIES OF MERCHANTABILITY,
# FITNESS FOR A PARTICULAR PURPOSE AND NONINFRINGEMENT. IN NO EVENT SHALL THE
# AUTHORS OR COPYRIGHT HOLDERS BE LIABLE FOR ANY CLAIM, DAMAGES OR OTHER
# LIABILITY, WHETHER IN AN ACTION OF CONTRACT, TORT OR OTHERWISE, ARISING FROM,
# OUT OF OR IN CONNECTION WITH THE SOFTWARE OR THE USE OR OTHER DEALINGS IN THE
# SOFTWARE.



""" Main entry point to launch sDNA_GH if run as a script from an sDNA_GH GhPython component.

    Imports the python package sDNA_GH and (re)defines the MyComponent(component) 
    class.  Grasshopper instantiates this class in each such GhPython
    component (set to SDK mode which the builder has done), then calls its 
    RunScript method. (This RunScript method is also called subsequently
    on each Param update / Grasshopper canvas recalculation).

    There may be multiple components, all running this same launcher code.
    Therefore we want the root logger to live in the sDNA_GH.main module
    that they each import.  The logging system is configurable by the user,
    but only through the options that are read in during the main package
    import, and we want to create logs before this too, in this module.  So 
    before a component has imported sDNA_GH.main, logging is routed through output, 
    a callable instance of Output, with a cache, defined below.  After a logger has 
    been set up according to the user's configuration, after the main package import,
    output's cache is flushed through the normal logging system, 

    Also, the Output class is used to define two Classes from this single 
    code definition.  Python scripts can happily import themselves, but here
    this is because launcher.py is itself part of the imported sDNA_GH python
    package, imported by launcher.py in a GhPython component.  To achieve this, the 
    code in this file needs to be copied into the sDNA_GH GhPython components 
    during building of the components (e.g. via the code input Param), 

    The behaviours can be different of course if changes are made to one and not
    the other. e.g. if updated code is forgotten to be copied into the component.

    A dummy MyComponent(component) class is defined in the script to appease
    GhPython's parser, even though the definition we use is imported from the package

    launcher.py can also run unit tests in a component named "selftest" 
"""

__authors__ = {'James Parrott', 'Crispin Cooper'}
__version__ = '3.0.1'



import sys
import os
import functools
import importlib

from ghpythonlib.componentbase import executingcomponent as component
import Grasshopper
import scriptcontext as sc

import_module = importlib.import_module
try:
    reload #type: ignore
except NameError:
    reload = importlib.reload

try:
    basestring #type: ignore
except NameError:
    basestring = str

try:
    ghdoc #type: ignore
except NameError:
    from .skel.basic.ghdoc import ghdoc

ZIP_FILE_NAME = 'sdna-gh'
PACKAGE_NAME = 'sDNA_GH'
PLUG_IN_NAME = 'sDNA'               
RELOAD_IF_ALREADY_IMPORTED = False
REPOSITORY = os.path.dirname(os.path.dirname(ghdoc.Path)) if ghdoc.Path else None
# Assume we are in repo_folder/dev/sDNA_build_components.gh

SELFTEST = 'selftest'
APITEST_PREFIX = 'sDNA_GH_API_test_'
DEPS = ['toml_tools', 'shapefile', 'mapclassif_Iron']

def get_dir_of_python_package_containing_ghuser():
    # Assume this is run from a Grasshopper component in a .ghuser file, in some
    # sub-directory called PACAKGE_NAME.
    #
    # Tries to find the root dir of PACKAGE_NAME, in case the plug-in's zip file 
    # was extracted somewhere other than C:\Users\...\AppData\Roaming\Grasshopper\UserObjects
    #
    # False positives are possible if there are multiple sDNA_GH installations.

    gh_comp_server = Grasshopper.Kernel.GH_ComponentServer()

    for file_ in gh_comp_server.ExternalFiles(True, True):
        path = file_.FilePath
        if PACKAGE_NAME in path:
            break
        #
    else: # for loop did not break
        return None

    dir_ = os.path.dirname(path)

    while PACKAGE_NAME in dir_:
        dir_ = os.path.dirname(dir_)

    return dir_



class Output(object): 

    def set_logger(self, logger, flush = True):
        self.logger = logger
        if flush and self.tmp_logs:
            self.flush()

    def __init__(self
                ,tmp_logs = None
                ,logger = None
                ):
        if not isinstance(tmp_logs, list): #assert not isinstance(None, list)
            tmp_logs = []
        self.tmp_logs = tmp_logs
        self.set_logger(logger, flush = False)



    def store(self, message, logging_level):
        self.tmp_logs.append( (message, logging_level) )

    def __call__(self, message, logging_level = "INFO", logging_dict = {}):
        #type: (str, str, dict, list) -> str
        
        #logger.debug(s)

        if logging_dict == {} and self.logger is not None: 
            logging_dict = dict( DEBUG = self.logger.debug
                                ,INFO = self.logger.info
                                ,WARNING = self.logger.warning
                                ,ERROR = self.logger.error
                                ,CRITICAL = self.logger.critical
                                )

        logging_level = logging_level.upper()
        if logging_level in logging_dict:
            logging_dict[logging_level](message)
        else:
            self.store(message, logging_level)

        return '%s : %s ' % (logging_level, message)

    def __getattr__(self, attr):
        return functools.partial(self.__call__, logging_level = attr.upper())

    def flush(self):
        tmp_logs = self.tmp_logs[:] # __call__ might cache back to tmp_logs
        self.tmp_logs[:] = [] # Mutate list initialised with.  Avoid double 
                              # logging in case re - stored in tmp_logs
        for tmp_log_message, tmp_log_level in tmp_logs:
            self.__call__(tmp_log_message, tmp_log_level)

output = Output()


class InvalidArgsError(Exception):
    
    """Custom exception to log the error message, and to at least allow 
       attempts to give users actionable advice to fix the issue, in 
       the event of a problem.  
    """
    message_fmt = 'Invalid import args: %s'
    def __init__(self
                ,message_fmt = ''
                ,message = ''
                ,logger = output
                , **kwargs
                ):
        if message_fmt and isinstance(message_fmt, basestring):
            self.message_fmt = message_fmt
        if kwargs and (not message or not isinstance(message, basestring)):
            message = self.message_fmt % kwargs
        logger.error(message)
        self.kwargs = kwargs
        super(InvalidArgsError, self).__init__(message)    


class ModuleNameError(InvalidArgsError):
    message_fmt = 'Invalid module name: %s'


class FilePathError(InvalidArgsError):
    message_fmt = 'Invalid path to import module from: %s'


# We only know the sDNA version to import as a string.  This is more secure too.
def _import(module_name = ''
                 ,folder = ''
                 ,sub_folder = ''
                 ,logger = output
                 ,reload_already_imported = RELOAD_IF_ALREADY_IMPORTED
                 ,strict=True
                 ):

    # type: (str, str, str, type[any], bool) -> type[any]
    """ Imports the named module from the specified folder\subfolder only, 
        and returns it.
        
        Avoids name clashes and casual hijack attempts.  In some 
        environments supporting a Python implementation (such as 
        GhPython in Grasshopper) it may not be desirable to ask the user 
        to set PYTHONPATH.  Hence here, we insert the specified folder
        into sys.path (if they are not already in there).
    """
    if not module_name or not isinstance(module_name, basestring):
        raise ModuleNameError(module_name = module_name
                             ,folder = folder
                             ,sub_folder = sub_folder
                             ,logger = logger
                             )
    logger.debug(module_name)
    if module_name in sys.modules:   # sys.modules is also shared between GHPython components 
                                     # (and is even saved until Rhino is closed).
        logger.debug('Module %s already in sys.modules' % module_name)
        if reload_already_imported:
            logger.debug('Reloading %s.... ' % module_name)
            reload(sys.modules[module_name]) # type: ignore
        return sys.modules[module_name]
    #
    #
    # Load module_name for first time:
    #
    #
    search_path = os.path.join(folder, sub_folder)

    old_sys_dot_path = sys.path

    if (search_path 
        and isinstance(search_path, basestring) 
        and os.path.isdir(search_path)):
        #
        logger.debug('Search path == %s' % search_path)

        if search_path not in sys.path:
            if strict:
                logger.warning('Prepending sys.path with: %s' % search_path)
                sys.path.insert(0, search_path)
            else:
                logger.warning('Appending sys.path with: %s' % search_path)
                sys.path.append(search_path)

    else:
        raise FilePathError(module_name = module_name
                           ,search_path = search_path
                           ,logger = logger
                           )

    logger.debug('Trying import... ')
    try:
        module = import_module(module_name, '')
        return module       
    finally:
        sys.path = old_sys_dot_path

    raise Exception('Could not import module: %s from: %s' % (module_name, search_path))




class ModulesNotFoundError(InvalidArgsError):
    message_fmt = 'Modules not found in any location %s'

def find_complete_installation_dir(
    m_names,
    dirs,
    logger = output,
    folders_error_msg = 'Please supply valid folders to import from. %s',
    ):
    #type(list[str], list[str], type[any], str) -> str

    logger.debug('Testing paths : %s ' % dirs)
    
    if isinstance(dirs, basestring):
        dirs = [dirs]


    if not any(os.path.isdir(dir_) or os.path.isdir(os.path.dirname(dir_)) 
               for dir_ in dirs
              ):
        raise FilePathError(message_fmt = folders_error_msg
                           ,m_names = m_names
                           ,logger = logger
                           )

    for dir_ in dirs:
        logger.debug('Type(dir_) : %s' % type(dir_).__name__)
        logger.debug('Type(path) : %s path == %s' %(type(dir_).__name__, dir_))

        if os.path.isfile(dir_):
            dir_ = os.path.dirname(dir_)
        if all( any(os.path.isfile(os.path.join(dir_, name.replace('.', os.sep) + ending)) 
                    for ending in ['.py','.pyc', '%s__init__.py' % os.sep ] 
                   )
                for name in m_names
              ):
            #
            logger.debug('Importing %s' % repr(m_names))
            return dir_

    # No directory found in dirs containing all modules
    raise ModulesNotFoundError(
                     message_fmt = modules_not_found_msg
                    ,m_names = m_names
                    ,folders = dirs
                    ,logger = logger
                    )

def load_modules(m_names
                ,folders
                ,logger = output
                ,module_name_error_msg = 'Please supply valid names of modules to import, %s'
                ,folders_error_msg = 'Please supply valid folders to import from. %s'
                ,modules_not_found_msg = 'Specified modules not found in any folder, %s'
                ):
    #type(str/ Iterable, list, type[any], str, str) -> tuple / None
    """ Tries to import all modules in m_names, from the first folder in 
        folders to contain a .py or .pyc files with the same name as each 
        module.

        Returns a tuple of all the modules and the path they were found in.  Else 
        raises a ModulesNotFoundError.
    """
    if not m_names:
        raise ModuleNameError(message_fmt = 'No module names supplied, m_names = %s'
                             ,m_names = m_names
                             ,logger = logger
                             )

    if isinstance(m_names, basestring):
        m_names = [m_names] 

    if any( not isinstance(m_name, basestring) for m_name in m_names ):
        raise ModuleNameError(message_fmt = module_name_error_msg
                             ,m_names = m_names
                             ,logger = logger
                             )
    
    logger.debug('m_names == %s of type : %s' % (m_names, type(m_names).__name__))

    if all(m_name in sys.modules for m_name in m_names):
        last_module_name = m_names[-1]
        last_module = sys.modules[last_module_name]
        folder = os.path.dirname(os.path.dirname(last_module.__file__))
    else:
        folder = find_complete_installation_dir(
            m_names,
            folders,
            logger,
            folders_error_msg,
            )

    # tuple of modules, and the path to them all
    return tuple(_import(name, folder, '', logger = logger) 
                    for name in m_names
                ) + (folder,)


class MissingEnvironmentVariable(Exception):
    pass


if __name__ == '__main__': # False in a compiled component.  But then the user
                           # can't add or remove Params to the component.  
    
    # Grasshopper will look for class MyComponent(component) in global scope
    # so a main() guard function is a little tricky to define.






    nick_name = ghenv.Component.NickName #type: ignore

    main_sDNA_GH_module = '%s.main' % PACKAGE_NAME
    checkers_module_name = '%s.skel.tools.helpers.checkers' % PACKAGE_NAME
    test_runners_module_name = '%s.tests.test_running_component_classes' % PACKAGE_NAME

    # builder can only load sDNA_GH from its parent directory, 
    # e.g. if in a dir one level up in the main repo
    # such as sDNA_build_components.gh.
    if (REPOSITORY and 
        nick_name == 'Build_components'):
        #
        build_env_custom_deps = os.getenv('SDNA_GH_BUILD_DEPS', None)

        if build_env_custom_deps is None:
            raise MissingEnvironmentVariable(
                'The environment variable SDNA_GH_BUILD_DEPS must be set '
                'to a directory containing the dependencies: ' + ', '.join(DEPS) +
                '. Run the components builder via "build_components.bat'
                ', or by building a Python wheel from the source repo. '
                ) 
        #

        sDNA_GH_search_paths = [os.path.join(REPOSITORY, 'src')]

        
        load_modules(
                 m_names = DEPS
                ,folders = build_env_custom_deps
                ,folders_error_msg = ('Could not find deps: %s in folder: %s'
                                        % (DEPS, build_env_custom_deps)
                                        )
                ,modules_not_found_msg = (
                                        'Failed to import deps: %s from folder: %s'
                                        % (DEPS, build_env_custom_deps)
                                        )
                )
    else:
        sDNA_GH_search_paths = [get_dir_of_python_package_containing_ghuser()]
        
    

    sc.doc = ghdoc #type: ignore

    output.debug(sDNA_GH_search_paths)


    class sDNA_GH(object):
        pass

    sDNA_GH.main, checkers, test_runners, sDNA_GH_path = load_modules(
             m_names = [main_sDNA_GH_module,
                        checkers_module_name,
                        test_runners_module_name,
                       ]
            ,folders = sDNA_GH_search_paths
            ,folders_error_msg = ('Please unzip %s.zip '
                                 +' in the folder %s '
                                 +'and ensure a subfolder called %s is created '
                                 +'inside it, containing main.py ' 
                                 +'and all the sDNA_GH python files '
                                 +'including those within other subfolders. '
                                 ) % (ZIP_FILE_NAME
                                     ,Grasshopper.Folders.DefaultUserObjectFolder
                                     ,os.path.join(ZIP_FILE_NAME, PACKAGE_NAME)
                                     )
            ,modules_not_found_msg = ('Some sDNA_GH files may be missing.  '
                                     +'Please: 1) Copy %s.zip into: %s '
                                     +'2) Unblock it if necessary. '
                                     +'3) Right click '
                                     +'it, select Extract All... and click Extract, '
                                     +'to extract it to that location. '
                                     +'4) Ensure that main.py and all sDNA_GH python' 
                                     +' files and subfolders are inside: %s '
                                     +'5) Reinitialise the component or restart Rhino.'
                                     ) % (ZIP_FILE_NAME
                                         ,Grasshopper.Folders.DefaultUserObjectFolder
                                         ,os.path.join(Grasshopper.Folders.DefaultUserObjectFolder
                                                      ,ZIP_FILE_NAME  
                                                      ,PACKAGE_NAME
                                                      )
                                         )
            )

    




    logger = sDNA_GH.main.logger.getChild('launcher')
    output.set_logger(logger, flush = True)


    class MyComponent(component):
        pass  # Required.  Idiomatic to Grasshopper.  Must be called "MyComponent"  
              # too (it is looked for by the parser or scope checker?) otherwise 
              # Grasshopper may not find the subclass of on 
              # component.  Even though we overwrite this class on the next line
              # immediately below.  


    log_file_dir = os.path.dirname(checkers.get_path(fallback = sDNA_GH_path))

    if nick_name.replace(' ','').replace('_','').lower() == SELFTEST:  
        MyComponent = test_runners.make_test_running_component_class(
                                             log_file_dir = log_file_dir
                                            ,start_dir = sDNA_GH_path
                                            )
    elif nick_name.startswith(APITEST_PREFIX):

        if not os.getenv('NUM_TESTS'):
            raise Exception('The environment variable: NUM_TESTS must be set. ')

        MyComponent = test_runners.make_noninteractive_api_test_running_component_class(
                 test_name = nick_name.partition(APITEST_PREFIX)[2]
                ,log_file_dir = log_file_dir
                )
    else:
        MyComponent = sDNA_GH.main.sDNA_GH_Component
        # Grasshopper calls MyComponent.RunScript automatically (in SDK mode GhPython components).
# ---------- end config ----------
add_build_env_to_sys_path = Unload_sDNA()  # -> out, OK, a; disabled
# ---------- add_build_env_to_sys_path: Python ----------
import os
import sys
import Grasshopper

PATHS = (os.path.join(Grasshopper.Folders.DefaultUserObjectFolder, 'sdna-gh')
        ,r'C:\Users\drjam\Coding\repos\sDNA_GH\src'
        )



if go:
    for path in PATHS:
        if path in sys.path:
            continue
        sys.path.append(path)

    OK = True
#    
#    import sDNA_GH.main
#    import sDNA_GH.launcher
#    import sDNA_GH.tests.test_running_component_classes
    
else:
    OK = False
# ---------- end add_build_env_to_sys_path ----------
set_build_deps_env_var = GhPythonScript(go=button)  # -> out, OK, opts; inputs go: list, opts: list
#   port go: true: runs tools. false: do not run tools but still read other Params.
# ---------- set_build_deps_env_var: Python ----------
import os

env = os.environ

if go:
    env['SDNA_GH_BUILD_DEPS'] = r'C:\Users\drjam\Coding\venvs\sDNA_GH_build\Lib\site-packages'
# ---------- end set_build_deps_env_var ----------
build_components = GhPythonScript()  # -> out; disabled
# ---------- build_components: Python ----------
from ghpythonlib.componentbase import executingcomponent as component
import Grasshopper, GhPython
import System
import Rhino
import rhinoscriptsyntax as rs

class MyComponent(component):
    
    def RunScript(self, x, y):
        """Provides a scripting component.
            Inputs:
                x: The x script variable
                y: The y script variable
            Output:
                a: The a output variable"""
        
        __author__ = "James"
        __version__ = "2022.07.13"
        
        import rhinoscriptsyntax as rs
        
        # return outputs if you have them; here I try it for you:
        return a
# ---------- end build_components ----------
build_components_2 = GhPythonScript(go=Toggle(True))  # -> out, OK, opts; inputs go: list, opts: list
#   port go: true: runs tools. false: do not run tools but still read other Params.
#   port opts: sDNA_GH options data structure. Python dictionary.
#   port OK: true: tools ran successfully. false: tools did not run, or there was an error.
#   port opts: sDNA_GH options data structure. Python dictionary.
# ---------- build_components_2: Python ----------
#! /usr/bin/awk NR==3
# -*- coding: utf-8 -*-
# This module requires Grasshopper Python (Rhino3D)

# MIT License

# Copyright (c) [2021] [Cardiff University, a body incorporated
# by Royal Charter and a registered charity (number:
# 1136855) whose administrative offices are at 7th floor 30-
# 36 Newport Road, University CF24 0DE, Wales, UK]

# Permission is hereby granted, free of charge, to any person obtaining a copy
# of this software and associated documentation files (the "Software"), to deal
# in the Software without restriction, including without limitation the rights
# to use, copy, modify, merge, publish, distribute, sublicense, and/or sell
# copies of the Software, and to permit persons to whom the Software is
# furnished to do so, subject to the following conditions:

# The above copyright notice and this permission notice shall be included in all
# copies or substantial portions of the Software.

# THE SOFTWARE IS PROVIDED "AS IS", WITHOUT WARRANTY OF ANY KIND, EXPRESS OR
# IMPLIED, INCLUDING BUT NOT LIMITED TO THE WARRANTIES OF MERCHANTABILITY,
# FITNESS FOR A PARTICULAR PURPOSE AND NONINFRINGEMENT. IN NO EVENT SHALL THE
# AUTHORS OR COPYRIGHT HOLDERS BE LIABLE FOR ANY CLAIM, DAMAGES OR OTHER
# LIABILITY, WHETHER IN AN ACTION OF CONTRACT, TORT OR OTHERWISE, ARISING FROM,
# OUT OF OR IN CONNECTION WITH THE SOFTWARE OR THE USE OR OTHER DEALINGS IN THE
# SOFTWARE.



""" Main entry point to launch sDNA_GH if run as a script from an sDNA_GH GhPython component.

    Imports the python package sDNA_GH and (re)defines the MyComponent(component) 
    class.  Grasshopper instantiates this class in each such GhPython
    component (set to SDK mode which the builder has done), then calls its 
    RunScript method. (This RunScript method is also called subsequently
    on each Param update / Grasshopper canvas recalculation).

    There may be multiple components, all running this same launcher code.
    Therefore we want the root logger to live in the sDNA_GH.main module
    that they each import.  The logging system is configurable by the user,
    but only through the options that are read in during the main package
    import, and we want to create logs before this too, in this module.  So 
    before a component has imported sDNA_GH.main, logging is routed through output, 
    a callable instance of Output, with a cache, defined below.  After a logger has 
    been set up according to the user's configuration, after the main package import,
    output's cache is flushed through the normal logging system, 

    Also, the Output class is used to define two Classes from this single 
    code definition.  Python scripts can happily import themselves, but here
    this is because launcher.py is itself part of the imported sDNA_GH python
    package, imported by launcher.py in a GhPython component.  To achieve this, the 
    code in this file needs to be copied into the sDNA_GH GhPython components 
    during building of the components (e.g. via the code input Param), 

    The behaviours can be different of course if changes are made to one and not
    the other. e.g. if updated code is forgotten to be copied into the component.

    A dummy MyComponent(component) class is defined in the script to appease
    GhPython's parser, even though the definition we use is imported from the package

    launcher.py can also run unit tests in a component named "selftest" 
"""

__authors__ = {'James Parrott', 'Crispin Cooper'}
__version__ = '3.0.1'



import sys
import os
import functools
import importlib

from ghpythonlib.componentbase import executingcomponent as component
import Grasshopper
import scriptcontext as sc

import_module = importlib.import_module
try:
    reload #type: ignore
except NameError:
    reload = importlib.reload

try:
    basestring #type: ignore
except NameError:
    basestring = str

try:
    ghdoc #type: ignore
except NameError:
    from .skel.basic.ghdoc import ghdoc

ZIP_FILE_NAME = 'sdna-gh'
PACKAGE_NAME = 'sDNA_GH'
PLUG_IN_NAME = 'sDNA'               
RELOAD_IF_ALREADY_IMPORTED = False
REPOSITORY = os.path.dirname(os.path.dirname(ghdoc.Path)) if ghdoc.Path else None
# Assume we are in repo_folder/dev/sDNA_build_components.gh

SELFTEST = 'selftest'
APITEST_PREFIX = 'sDNA_GH_API_test_'
DEPS = ['toml_tools', 'shapefile', 'mapclassif_Iron']


def get_dir_of_python_package_containing_ghuser():
    # Assume this is run from a Grasshopper component in a .ghuser file, in some
    # sub-directory called PACKAGE_NAME.
    #
    # Tries to find the root dir of PACKAGE_NAME, in case the plug-in's zip file 
    # was extracted somewhere other than C:\Users\...\AppData\Roaming\Grasshopper\UserObjects
    #
    # False positives are possible if there are multiple sDNA_GH installations.

    gh_comp_server = Grasshopper.Kernel.GH_ComponentServer()

    for file_ in gh_comp_server.ExternalFiles(True, True):
        path = file_.FilePath
        if PACKAGE_NAME in path:
            break
        #
    else: # for loop did not break
        return None

    dir_ = os.path.dirname(path)

    while PACKAGE_NAME in dir_:
        dir_ = os.path.dirname(dir_)

    return dir_



class Output(object): 

    def set_logger(self, logger, flush = True):
        self.logger = logger
        if flush and self.tmp_logs:
            self.flush()

    def __init__(self
                ,tmp_logs = None
                ,logger = None
                ):
        if not isinstance(tmp_logs, list): #assert not isinstance(None, list)
            tmp_logs = []
        self.tmp_logs = tmp_logs
        self.set_logger(logger, flush = False)



    def store(self, message, logging_level):
        self.tmp_logs.append( (message, logging_level) )

    def __call__(self, message, logging_level = "INFO", logging_dict = {}):
        #type: (str, str, dict, list) -> str
        
        #logger.debug(s)

        if logging_dict == {} and self.logger is not None: 
            logging_dict = dict( DEBUG = self.logger.debug
                                ,INFO = self.logger.info
                                ,WARNING = self.logger.warning
                                ,ERROR = self.logger.error
                                ,CRITICAL = self.logger.critical
                                )

        logging_level = logging_level.upper()
        if logging_level in logging_dict:
            logging_dict[logging_level](message)
        else:
            self.store(message, logging_level)

        return '%s : %s ' % (logging_level, message)

    def __getattr__(self, attr):
        return functools.partial(self.__call__, logging_level = attr.upper())

    def flush(self):
        tmp_logs = self.tmp_logs[:] # __call__ might cache back to tmp_logs
        self.tmp_logs[:] = [] # Mutate list initialised with.  Avoid double 
                              # logging in case re - stored in tmp_logs
        for tmp_log_message, tmp_log_level in tmp_logs:
            self.__call__(tmp_log_message, tmp_log_level)

output = Output()


class InvalidArgsError(Exception):
    
    """Custom exception to log the error message, and to at least allow 
       attempts to give users actionable advice to fix the issue, in 
       the event of a problem.  
    """
    message_fmt = 'Invalid import args: %s'
    def __init__(self
                ,message_fmt = ''
                ,message = ''
                ,logger = output
                , **kwargs
                ):
        if message_fmt and isinstance(message_fmt, basestring):
            self.message_fmt = message_fmt
        if kwargs and (not message or not isinstance(message, basestring)):
            message = self.message_fmt % kwargs
        logger.error(message)
        self.kwargs = kwargs
        super(InvalidArgsError, self).__init__(message)    


class ModuleNameError(InvalidArgsError):
    message_fmt = 'Invalid module name: %s'


class FilePathError(InvalidArgsError):
    message_fmt = 'Invalid path to import module from: %s'


# We only know the sDNA version to import as a string.  This is more secure too.
def _import(module_name = ''
           ,folder = ''
           ,sub_folder = ''
           ,logger = output
           ,reload_already_imported = RELOAD_IF_ALREADY_IMPORTED
           ,strict=True
           ):

    # type: (str, str, str, type[any], bool) -> type[any]
    """ Imports the named module from the specified folder\subfolder only, 
        and returns it.
        
        Avoids name clashes and casual hijack attempts.  In some 
        environments supporting a Python implementation (such as 
        GhPython in Grasshopper) it may not be desirable to ask the user 
        to set PYTHONPATH.  Hence here, we insert the specified folder
        into sys.path (if they are not already in there).
    """
    if not module_name or not isinstance(module_name, basestring):
        raise ModuleNameError(module_name = module_name
                             ,folder = folder
                             ,sub_folder = sub_folder
                             ,logger = logger
                             )
    logger.debug(module_name)
    if module_name in sys.modules:   # sys.modules is also shared between GHPython components 
                                     # (and is even saved until Rhino is closed).
        logger.debug('Module %s already in sys.modules' % module_name)
        if reload_already_imported:
            logger.debug('Reloading %s.... ' % module_name)
            reload(sys.modules[module_name]) # type: ignore
        return sys.modules[module_name]
    #
    #
    # Load module_name for first time:
    #
    #
    search_path = os.path.join(folder, sub_folder)

    old_sys_dot_path = sys.path

    if (search_path 
        and isinstance(search_path, basestring) 
        and os.path.isdir(search_path)):
        #
        logger.debug('Search path == %s' % search_path)

        if search_path not in sys.path:
            if strict:
                logger.warning('Prepending sys.path with: %s' % search_path)
                sys.path.insert(0, search_path)
            else:
                logger.warning('Appending sys.path with: %s' % search_path)
                sys.path.append(search_path)

    elif strict:
        raise FilePathError(module_name = module_name
                           ,search_path = search_path
                           ,logger = logger
                           )

    logger.debug('Trying import... ')
    try:
        module = import_module(module_name, '')
        return module       
    finally:
        sys.path = old_sys_dot_path

    raise Exception('Could not import module: %s from: %s' % (module_name, search_path))




class ModulesNotFoundError(InvalidArgsError):
    message_fmt = 'Modules not found in any location %s'

def find_complete_installation_dir(
    m_names,
    dirs,
    logger = output,
    folders_error_msg = 'Please supply valid folders to import from. %s',
    ):
    #type(list[str], list[str], type[any], str) -> str

    logger.debug('Testing paths : %s ' % dirs)
    
    if isinstance(dirs, basestring):
        dirs = [dirs]


    if not any(os.path.isdir(dir_) or os.path.isdir(os.path.dirname(dir_)) 
               for dir_ in dirs
              ):
        raise FilePathError(message_fmt = folders_error_msg
                           ,m_names = m_names
                           ,logger = logger
                           )

    for dir_ in dirs:
        logger.debug('Type(dir_) : %s' % type(dir_).__name__)
        logger.debug('Type(path) : %s path == %s' %(type(dir_).__name__, dir_))

        if os.path.isfile(dir_):
            dir_ = os.path.dirname(dir_)
        if all( any(os.path.isfile(os.path.join(dir_, name.replace('.', os.sep) + ending)) 
                    for ending in ['.py','.pyc', '%s__init__.py' % os.sep ] 
                   )
                for name in m_names
              ):
            #
            logger.debug('Importing %s' % repr(m_names))
            return dir_

    # No directory found in dirs containing all modules
    raise ModulesNotFoundError(
                     message_fmt = modules_not_found_msg
                    ,m_names = m_names
                    ,folders = dirs
                    ,logger = logger
                    )

def load_modules(m_names
                ,folders
                ,logger = output
                ,module_name_error_msg = 'Please supply valid names of modules to import, %s'
                ,folders_error_msg = 'Please supply valid folders to import from. %s'
                ,modules_not_found_msg = 'Specified modules not found in any folder, %s'
                ):
    #type(str/ Iterable, list, type[any], str, str) -> tuple / None
    """ Tries to import all modules in m_names, from the first folder in 
        folders to contain a .py or .pyc files with the same name as each 
        module.

        Returns a tuple of all the modules and the path they were found in.  Else 
        raises a ModulesNotFoundError.
    """
    if not m_names:
        raise ModuleNameError(message_fmt = 'No module names supplied, m_names = %s'
                             ,m_names = m_names
                             ,logger = logger
                             )

    if isinstance(m_names, basestring):
        m_names = [m_names] 

    if any( not isinstance(m_name, basestring) for m_name in m_names ):
        raise ModuleNameError(message_fmt = module_name_error_msg
                             ,m_names = m_names
                             ,logger = logger
                             )
    
    logger.debug('m_names == %s of type : %s' % (m_names, type(m_names).__name__))

    if all(m_name in sys.modules for m_name in m_names):
        last_module_name = m_names[-1]
        last_module = sys.modules[last_module_name]
        folder = os.path.dirname(os.path.dirname(last_module.__file__))
    else:
        folder = find_complete_installation_dir(
            m_names,
            folders,
            logger,
            folders_error_msg,
            )

    # tuple of modules, and the path to them all
    return tuple(_import(name, folder, '', logger = logger) 
                    for name in m_names
                ) + (folder,)


class MissingEnvironmentVariable(Exception):
    pass


if __name__ == '__main__': # False in a compiled component.  But then the user
                           # can't add or remove Params to the component.  
    
    # Grasshopper will look for class MyComponent(component) in global scope
    # so a main() guard function is a little tricky to define.






    nick_name = ghenv.Component.NickName #type: ignore

    main_sDNA_GH_module = '%s.main' % PACKAGE_NAME
    checkers_module_name = '%s.skel.tools.helpers.checkers' % PACKAGE_NAME
    test_runners_module_name = '%s.tests.test_running_component_classes' % PACKAGE_NAME

    # builder can only load sDNA_GH from its parent directory, 
    # e.g. if in a dir one level up in the main repo
    # such as sDNA_build_components.gh.
    if (REPOSITORY and 
        nick_name == 'Build_components'):
        #
        build_env_custom_deps = os.getenv('SDNA_GH_BUILD_DEPS', None)

        if build_env_custom_deps is None:
            raise MissingEnvironmentVariable(
                'The environment variable SDNA_GH_BUILD_DEPS must be set '
                'to a directory containing the dependencies: ' + ', '.join(DEPS) +
                '. Run the components builder via "build_components.bat'
                ', or by building a Python wheel from the source repo. '
                ) 
        #

        sDNA_GH_search_paths = [os.path.join(REPOSITORY, 'src')]

        
        load_modules(
                 m_names = DEPS
                ,folders = build_env_custom_deps
                ,folders_error_msg = ('Could not find deps: %s in folder: %s'
                                        % (DEPS, build_env_custom_deps)
                                        )
                ,modules_not_found_msg = (
                                        'Failed to import deps: %s from folder: %s'
                                        % (DEPS, build_env_custom_deps)
                                        )
                )
    else:
        sDNA_GH_search_paths = [get_dir_of_python_package_containing_ghuser()]
        
    

    sc.doc = ghdoc #type: ignore

    output.debug(sDNA_GH_search_paths)


    class sDNA_GH(object):
        pass

    sDNA_GH.main, checkers, test_runners, sDNA_GH_path = load_modules(
             m_names = [main_sDNA_GH_module,
                        checkers_module_name,
                        test_runners_module_name,
                       ]
            ,folders = sDNA_GH_search_paths
            ,folders_error_msg = ('Please unzip %s.zip '
                                 +' in the folder %s '
                                 +'and ensure a subfolder called %s is created '
                                 +'inside it, containing main.py ' 
                                 +'and all the sDNA_GH python files '
                                 +'including those within other subfolders. '
                                 ) % (ZIP_FILE_NAME
                                     ,Grasshopper.Folders.DefaultUserObjectFolder
                                     ,os.path.join(ZIP_FILE_NAME, PACKAGE_NAME)
                                     )
            ,modules_not_found_msg = ('Some sDNA_GH files may be missing.  '
                                     +'Please: 1) Copy %s.zip into: %s '
                                     +'2) Unblock it if necessary. '
                                     +'3) Right click '
                                     +'it, select Extract All... and click Extract, '
                                     +'to extract it to that location. '
                                     +'4) Ensure that main.py and all sDNA_GH python' 
                                     +' files and subfolders are inside: %s '
                                     +'5) Reinitialise the component or restart Rhino.'
                                     ) % (ZIP_FILE_NAME
                                         ,Grasshopper.Folders.DefaultUserObjectFolder
                                         ,os.path.join(Grasshopper.Folders.DefaultUserObjectFolder
                                                      ,ZIP_FILE_NAME  
                                                      ,PACKAGE_NAME
                                                      )
                                         )
            )

    




    logger = sDNA_GH.main.logger.getChild('launcher')
    output.set_logger(logger, flush = True)


    class MyComponent(component):
        pass  # Required.  Idiomatic to Grasshopper.  Must be called "MyComponent"  
              # too (it is looked for by the parser or scope checker?) otherwise 
              # Grasshopper may not find the subclass of on 
              # component.  Even though we overwrite this class on the next line
              # immediately below.  


    log_file_dir = os.path.dirname(checkers.get_path(fallback = sDNA_GH_path))

    if nick_name.replace(' ','').replace('_','').lower() == SELFTEST:  
        MyComponent = test_runners.make_test_running_component_class(
                                             log_file_dir = log_file_dir
                                            ,start_dir = sDNA_GH_path
                                            )
    elif nick_name.startswith(APITEST_PREFIX):

        if not os.getenv('NUM_TESTS'):
            raise Exception('The environment variable: NUM_TESTS must be set. ')

        MyComponent = test_runners.make_noninteractive_api_test_running_component_class(
                 test_name = nick_name.partition(APITEST_PREFIX)[2]
                ,log_file_dir = log_file_dir
                )
    else:
        MyComponent = sDNA_GH.main.sDNA_GH_Component
        # Grasshopper calls MyComponent.RunScript automatically (in SDK mode GhPython components).
# ---------- end build_components_2 ----------
python = GhPythonScript()  # disabled; same code as config
show_auto_options = GhPythonScript()  # -> out, a; disabled
# ---------- show_auto_options: Python ----------
import os
os.environ['SDNA_GH_BUILD_DEPS'] = r'C:\Users\drjam\Coding\venvs\build_sDNA_GH\Lib\site-packages'
# ---------- end show_auto_options ----------
unload_sdna = Unload_sDNA(unload=Button())  # -> out, a
# ---------- unload_sdna: Python ----------
#! /usr/bin/awk NR==3
# -*- coding: utf-8 -*-
# This module requires Grasshopper Python (Rhino3D)

# MIT License

# Copyright (c) [2021] [Cardiff University, a body incorporated
# by Royal Charter and a registered charity (number:
# 1136855) whose administrative offices are at 7th floor 30-
# 36 Newport Road, UniversityCF24 0DE, Wales, UK]

# Permission is hereby granted, free of charge, to any person obtaining a copy
# of this software and associated documentation files (the "Software"), to deal
# in the Software without restriction, including without limitation the rights
# to use, copy, modify, merge, publish, distribute, sublicense, and/or sell
# copies of the Software, and to permit persons to whom the Software is
# furnished to do so, subject to the following conditions:

# The above copyright notice and this permission notice shall be included in all
# copies or substantial portions of the Software.

# THE SOFTWARE IS PROVIDED "AS IS", WITHOUT WARRANTY OF ANY KIND, EXPRESS OR
# IMPLIED, INCLUDING BUT NOT LIMITED TO THE WARRANTIES OF MERCHANTABILITY,
# FITNESS FOR A PARTICULAR PURPOSE AND NONINFRINGEMENT. IN NO EVENT SHALL THE
# AUTHORS OR COPYRIGHT HOLDERS BE LIABLE FOR ANY CLAIM, DAMAGES OR OTHER
# LIABILITY, WHETHER IN AN ACTION OF CONTRACT, TORT OR OTHERWISE, ARISING FROM,
# OUT OF OR IN CONNECTION WITH THE SOFTWARE OR THE USE OR OTHER DEALINGS IN THE
# SOFTWARE.

""" Unload the sDNA_GH Python package and all sDNA modules, by removing them from GhPython's shared cache (sys.modules).  The 
    next sDNA_GH component to run will then reload the package and installation-wide options file (config.toml), and any specified 
    options including a project specific config.toml, without otherwise having to restart Rhino to clear its cache.
"""

__author__ = 'James Parrott'
__version__ = '1.0'


from ghpythonlib.componentbase import executingcomponent as component

class MyComponent(component):
    
    def RunScript(self, unload, update):
        import sys  #Imported here to avoid weird bug 
                    # (unloading/forgetting of sys - IronPython only?)
        #https://discourse.mcneel.com/t/failed-import-of-sys-library-in-ghpython/98696


        print('sDNA_GH packages and modules in sys.modules:')
        print('\n'.join([key for key in sys.modules if 'sdna' in key.lower()]))
        def is_imported(s):
            return s in sys.modules
        if unload is True:
            if 'logging' in sys.modules:
                sys.modules['logging'].shutdown()
            shared_cached_modules_etc = sys.modules.copy().keys()
            for y in shared_cached_modules_etc:
                if 'sdna' in y.lower():
                    del sys.modules[y]
        
        
                
        print('sDNA_GH imported == %s' % is_imported('sDNA_GH'))
        print('sDNA_GH.tools imported == %s' % is_imported('sDNA_GH.tools'))
        print('sDNAUISpec imported == %s' % is_imported('sDNAUISpec'))
        print('runsdnacommand == %s' % is_imported('runsdnacommand'))

        
        return
# ---------- end unload_sdna ----------
config_2 = GhPythonScript()  # disabled; same code as config
show_auto_options_2 = GhPythonScript()  # -> out, a
# ---------- show_auto_options_2: Python ----------
__author__ = "James"
__version__ = "2022.06.21"

import rhinoscriptsyntax as rs

if x:
    options = x['options']
    print('\n'.join('%s == %s' % (attr, getattr(options, attr) )
                    for attr in options._fields
                    if attr.startswith('auto')
                    )
         )
    metas = x['metas']
    print('\n'.join('%s == %s' % (attr, getattr(metas, attr) )
                    for attr in metas._fields
                    if attr in ['show_all']
                    )
         )
# ---------- end show_auto_options_2 ----------
delete_sdna_gh = Button()
panel_3 = Panel(build_components_2.out)
update = Button()
self_test = GhPythonScript()  # -> out; disabled; same code as config
unload_sdna_2 = Unload_sDNA(unload=delete_sdna_gh, update=update)  # -> out, a
# ---------- unload_sdna_2: Python ----------
#! /usr/bin/awk NR==3
# -*- coding: utf-8 -*-
# This module requires Grasshopper Python (Rhino3D)

# MIT License

# Copyright (c) [2021] [Cardiff University, a body incorporated
# by Royal Charter and a registered charity (number:
# 1136855) whose administrative offices are at 7th floor 30-
# 36 Newport Road, University CF24 0DE, Wales, UK]

# Permission is hereby granted, free of charge, to any person obtaining a copy
# of this software and associated documentation files (the "Software"), to deal
# in the Software without restriction, including without limitation the rights
# to use, copy, modify, merge, publish, distribute, sublicense, and/or sell
# copies of the Software, and to permit persons to whom the Software is
# furnished to do so, subject to the following conditions:

# The above copyright notice and this permission notice shall be included in all
# copies or substantial portions of the Software.

# THE SOFTWARE IS PROVIDED "AS IS", WITHOUT WARRANTY OF ANY KIND, EXPRESS OR
# IMPLIED, INCLUDING BUT NOT LIMITED TO THE WARRANTIES OF MERCHANTABILITY,
# FITNESS FOR A PARTICULAR PURPOSE AND NONINFRINGEMENT. IN NO EVENT SHALL THE
# AUTHORS OR COPYRIGHT HOLDERS BE LIABLE FOR ANY CLAIM, DAMAGES OR OTHER
# LIABILITY, WHETHER IN AN ACTION OF CONTRACT, TORT OR OTHERWISE, ARISING FROM,
# OUT OF OR IN CONNECTION WITH THE SOFTWARE OR THE USE OR OTHER DEALINGS IN THE
# SOFTWARE.

""" Unload the sDNA_GH Python package and all sDNA modules, by removing them from GhPython's shared cache (sys.modules).  The 
    next sDNA_GH component to run will then reload the package and installation-wide options file (config.toml), and any specified 
    options including a project specific config.toml, without otherwise having to restart Rhino to clear its cache.
"""

__authors__ = {'James Parrott', 'Crispin Cooper'}
__version__ = '3.0.1'


from ghpythonlib.componentbase import executingcomponent as component


ghenv.Component.ToggleObsolete(False)

IMPORTS_TO_UNLOAD = {'sdna_gh'
                    ,'shapefile'
                    ,'toml_tools' 
                    ,'mapclassif_iron'
                    ,'anteater_gh'
                    ,'cheetah_gh'
                    }   

class MyComponent(component):
    
    def RunScript(self, unload, update):
        import sys  #Imported here to avoid weird bug 
                    # (unloading/forgetting of sys - IronPython only?)
        #https://discourse.mcneel.com/t/failed-import-of-sys-library-in-ghpython/98696


        print('sDNA_GH packages and modules in sys.modules:')
        print('\n'.join([key for key in sys.modules if 'sdna' in key.lower()]))
        def is_imported(s):
            return s in sys.modules
        if unload is True:
            if 'logging' in sys.modules:
                sys.modules['logging'].shutdown()
            shared_cached_modules_etc = sys.modules.copy().keys()
            for y in shared_cached_modules_etc:
                if any(s in y.lower() for s in IMPORTS_TO_UNLOAD):
                    del sys.modules[y]
        
        
                
        print('sDNA_GH imported == %s' % is_imported('sDNA_GH'))
        print('sDNA_GH.tools imported == %s' % is_imported('sDNA_GH.tools'))
        print('sDNAUISpec imported == %s' % is_imported('sDNAUISpec'))
        print('runsdnacommand == %s' % is_imported('runsdnacommand'))

        
        return
# ---------- end unload_sdna_2 ----------
panel_4 = Panel(unload_sdna_2.out)
readme_getter = GhPythonScript()  # -> out, a
# ---------- readme_getter: Python ----------
import os

from ghpythonlib.componentbase import executingcomponent as component
import Grasshopper, GhPython
import System
import Rhino
import rhinoscriptsyntax as rs

def text_file_to_str(file, extra_new_line_char = '', encoding = 'utf-8'):
    #type(str, str) -> str
    """ A simple text file reader.  """
    if file is None or not isinstance(file, basestring):
        msg = 'file == %s is not a string' % file
        logger.error(msg)
        raise TypeError(msg)
    elif not os.path.isfile(file):
        msg = 'file == %s is not a file path' % file
        logger.error(msg)
        raise ValueError(msg)
    else:
        with open(file, 'rb') as f:
            file_contents = extra_new_line_char.join(line.decode(encoding)
                                                     for line in f
                                                    )
    return file_contents

class MyComponent(component):
    
    def RunScript(self, x, y):
        
        sDNA_GH_path = os.path.dirname(ghdoc.Path)
        
        README_md_path = os.path.join(sDNA_GH_path, 'README.md')
        if not os.path.isfile(README_md_path):
            README_md_path = os.path.join(os.path.dirname(sDNA_GH_path), 'README.md')
        # Readme.md is a level higher in the repo than in the sDNA_GH
        # folder in a user installation - it is moved intentionally
        # by create_release_sDNA_GH_zip.bat 
        readme = text_file_to_str(README_md_path)
        a = 'anything'
        
        doc = self.Attributes.Owner.OnPingDocument()
        readme_component = next(component 
                                for component in doc.Objects
                                if component.NickName == 'Readme.txt'
                               ) 
        
        readme_component.SetUserText(readme)
        
        return a
# ---------- end readme_getter ----------
readme_txt = Panel("""# sDNA_GH
Authors
* James Parrott
* Crispin Cooper (Cardiff University)

sDNA is a world leading tool for Spatial Design Network Analysis.  sDNA_GH is a plug-in for Grasshopper providing components that run the tools from a local [sDNA](https://github.com/fiftysevendegreesofrad/sdna_open/releases) installation, on Rhino and Grasshopper geometry and data.  Currently requires Windows.

Shenzhen University and Hong Kong University funded the initial and subsequent development phases respectively.  Wedderburn Transport Planning and Alain Chiaradia worked on defining the idea, and staunchly supported the project along with Cardiff University.  Sara Nalaskowska, Siddharth Khakhar and Fan Zitian, all provided invaluable help during development and testing.  Huge thanks to all.


## sDNA_GH functionality
sDNA_GH: 
 - Reads a network's polyline Geometry from Rhino or Grasshopper.
 - Reads data from any User Text on Rhino objects. 
 - Writes a network's links (formed by one or more polylines), and associated data to shapefiles.
 - Initiates an sDNA tool that processes that shapefile, and e.g. carries out a network preparation or an analysis.
 - Reads polyline shapefiles produced by the sDNA tool, and any associated data e.g. the results from sDNA.
 - Parses the selected data field, and normalises and classifies the data, sorting the polylines if necessary.
 - Colours can be allocated to each polyline based on the parsed data, either using a Colour Gradient component, or automatically.   
 - Visually represents the results from sDNA by colouring a new layer of polylines, or the original Rhino shapes.
 - Allows easy adding of a native Legend.

## User manual.  
__version__ = '3.0.1'

## Table of contents

- [sDNA_GH](#sdna_gh)
  - [sDNA](#sdna)
  - [sDNA_GH functionality](#sdna_gh-functionality)
  - [User manual.](#user-manual)
    - [System Requirements.](#system-requirements)
      - [Software](#software)
      - [Hardware](#hardware)
    - [Installation.](#installation)
    - [Usage.](#usage)
      - [Components.](#components)
        - [Automatic multi-tools.](#automatic-multi-tools)
        - [Running individual tools.](#running-individual-tools)
        - [Component Execution Order.](#component-execution-order)
      - [Options.](#options)
        - [Adding Component Input and Output Params.](#adding-component-input-and-output-params)
        - [Logging options](#logging-options)
        - [Local meta options.](#local-meta-options)
        - [Shared state vs desynchronised components.](#shared-state-vs-desynchronised-components)
      - [Tools.](#tools)
        - [Common component input and output Params](#common-component-input-and-output-params)
        - [Support tools](#support-tools)
        - [Shapefile tools](#shapefile-tools)
        - [Plotting tools](#plotting-tools)
        - [User Text tools](#user-text-tools)
        - [Data tools](#data-tools)
      - [sDNA Tools](#sdna-tools)
        - [Analysis tools](#analysis-tools)
        - [Preparation tools](#preparation-tools)
        - [Geometric analysis tools](#geometric-analysis-tools)
        - [Calibration tools](#calibration-tools)
        - [Dev tool(s)](#dev-tools)
    - [Example Grasshopper definitions.](#example-grasshopper-definitions)
      - [Running sDNA Integral on a random grid read from Rhino.](#running-sdna-integral-on-a-random-grid-read-from-rhino)
        - [Selecting and specifying an sDNA Results field.](#selecting-and-specifying-an-sdna-results-field)
        - [Reading shapefile data with existing geometry.](#reading-shapefile-data-with-existing-geometry)
        - [Using a Grasshopper Colour gradient component.](#using-a-grasshopper-colour-gradient-component)
        - [Adding a legend with a Legend component.](#adding-a-legend-with-a-legend-component)
        - [Customising legend class boundaries and tag names.](#customising-legend-class-boundaries-and-tag-names)
      - [Running sDNA Integral on a random grid of Grasshopper geometry (colouring with the Custom Preview component).](#running-sdna-integral-on-a-random-grid-of-grasshopper-geometry-colouring-with-the-custom-preview-component)
      - [Running sDNA Integral on a network of polylines, approximating a network of arcs from intersecting circles.](#running-sdna-integral-on-a-network-of-polylines-approximating-a-network-of-arcs-from-intersecting-circles)
        - [Recolouring the arcs instead of polylines.](#recolouring-the-arcs-instead-of-polylines)
      - [Writing polylines and data to shapefiles.](#writing-polylines-and-data-to-shapefiles)
      - [Reading in polylines and data from shapefiles.](#reading-in-polylines-and-data-from-shapefiles)
      - [Writing User Text.](#writing-user-text)
      - [Reading User Text for sDNA (e.g. User weights).](#reading-user-text-for-sdna-eg-user-weights)
      - [Baking (saving Grasshopper objects to a Rhino document) with User Text. -->](#baking-saving-grasshopper-objects-to-a-rhino-document-with-user-text---)
    - [License.](#license)
    - [Copyright.](#copyright)
  - [Contact.](#contact)
  - [Developer manual.](#developer-manual)
    - [Dependencies.](#dependencies)
      - [](#)
    - [Build instructions.](#build-instructions)
      - [To build new sDNA components.](#to-build-new-sdna-components)
    - [Misc](#misc)


### System Requirements. 
#### Software
1. Windows (8.1, 10, or 11) 
2. Python.  (Please note non-CPythons, e.g. Iron Python, are not supported, as invalid shapefiles will be produced).
3. sDNA. 
4. Rhino and Grasshopper (tested in Rhino 7)
#### Hardware
1. 64-bit Intel or AMD processor (Not ARM) 
2. No more than 63 CPU Cores. 
3. 8 GB memory (RAM) or more is recommended. 
4. 1.2 GB disk space. 

### Installation.

#### Experimental installation via pip
`pip install --target=%APPDATA%\Grasshopper\UserObjects\sdna-gh sDNA_GH`
There are few modules in sDNA_GH that can be run outside of Grasshopper, let alone Rhino.  The
wheels (bdist releases) contain launcher components, and import the main sDNA_GH package.  
Therefore for most users, installation should target a folder from which Grasshopper will
find the sDNA_GH components, not in a venv or standard CPython installation.  The folder 
above is the same as for a standard installation.

#### Experimental installation in CPython 3 components (Rhino 8's Grasshopper, also via pip)
`#r: sDNA_GH`


#### Standard installation.
1. Ensure you have an installation of [Rhino 3D](https://www.rhino3d.com/download/) including Grasshopper (versions 6 and 7 are supported).

sDNA_GH provides some functionality without sDNA installed, e.g. Selecting real Rhino objects, User Text components, reading and writing shapefiles, parsing data, and recolouring objects.  But to use the sDNA components, an installation of sDNA is required.

#### sDNA dependencies.
sDNA itself may require the 64 bit (x64) Visual Studio redistributable [^0].  

#### Official sDNA installer (and Python).
2. Ensure you have a supported version of [Python](https://www.python.org/downloads/windows/) (CPython, the reference implementation).  Do not run sDNA in non CPythons, as invalid shape files will be produced.  sDNA has been tested with a lot of different CPython versions.  But these do not include the CPython shipped with Rhino 8.    
3. sDNA Learn requires numpy.  Numpy can be installed by opening a `cmd` window and typing: `python -m pip install numpy`.  Optional:  If this Python installation is also used by other 
processes, to guarantee there are no dependency conflicts, create a venv to run sDNA in, e.g. firstly by entering: `python -m venv <path_to_sDNA_venv>`  `<path_to_sDNA_venv>\Scripts\pip.exe install numpy` (enter `<path_to_sDNA_venv>\Scripts\activate.bat` to test the venv from the command line) and secondly within Grasshopper set
`python` to <path_to_sDNA_venv>\Scripts` on a config component (or in config.toml) in step 13.iii below. 
4. To use sDNA with sDNA_GH, ensure you have an installation of [sDNA](https://sdna.cardiff.ac.uk/sdna/software/download/).  sDNA+ is now [open source](https://github.com/fiftysevendegreesofrad/sdna_plus).  As above, sDNA may also require a Visual Studio redistributable.  If you chose a non-default installation directory, remember it for step 13.ii.


#### sDNA_GH

5. Download `sdna-gh.zip` from (food4rhino)[https://www.food4rhino.com/en/app/sdnagh] or the [sDNA_GH releases page on Github](https://github.com/JamesParrott/sDNA_GH/releases).
6. Ensure `sdna-gh.zip` is unblocked: Open File Explorer and go to your Downloads folder (or whichever folder you saved it in).  Right click it and select `Properties` from the bottom of the menu.  Then click on the _Unblock_ check box at the bottom (right of _Security_), then click `OK` or `Apply`.  The check box and _Security_ section should disappear.  This should unblock all the files in the zip archive.  Please do not automatically trust and unblock all software downloaded from anywhere on the internet [^1].  
7. Open Rhino and Grasshopper.
8. In Grasshopper's pull down menus (above the tabs ribbon at the top) click `File` -> `Special folders` -> `User Objects Folder`.  The default in Rhino 7 is `%appdata%\Grasshopper\UserObjects`.  Note, this is different to the Components Folder used by many other plug-ins (i.e. not `%appdata%\Grasshopper\Libraries`).
9. Copy `sdna-gh.zip` to this folder (e.g. it should be at `%appdata%\Grasshopper\UserObjects\sdna-gh.zip`).
10. Unzip `sdna-gh.zip` to this location (in Windows 10 right click `sdna-gh.zip` and select `Extract All ...`, then click `Extract` to use the suggested location).  In the User Objects folder, a new folder called `sdna-gh` should have been created, itself containing a subfolder called `sDNA_GH` (plus license.md and copies of these readme files).  If necessary, rename the outer parent folder (inside the User Objects folder) to exactly "sdna-gh" (no quotes). E.g. if you previously downloaded an earlier version of sDNA_GH (or any other file called) sdna-gh.zip, your web browser may have renamed a second download to sdna-gh(1).zip.  In this case, you will need to either rename the file or the folder created by unzipping it.

11. Restart Rhino and Grasshopper.
12. The sDNA_GH plug in components should now be available under a new "sDNA" tab in the ribbon amongst the tabs for all the plug-ins you have installed (right of `Mesh`, `Intersect`, `Transform` and `Display` etc).  
13. To use sDNA with sDNA_GH, if no preferences are specified, sDNA_GH will search for sDNA and Python installations automatically, using the first one of each it finds.  If you are using sDNA Learn with Python in a venv as recommended, or otherwise to ensure sDNA_GH uses a particular version of sDNA and the correct Python interpreter, it is recommended on first usage to:
    -place a Config component on the canvas (the component with a gear/cog icon in `Extra`).
    -Specify the file path of the sDNA folder (containing `sDNAUISpec.py` and `runsdnacommand.py`) of the sDNA installation you wish to use in the `sDNA_folders` input (e.g. `C:\Program Files (x86)\sDNA`).
    -Specify the file path of the sDNA venv's Python (e.g. <path_to_sDNA_venv>`\Scripts\python.exe` from step 3), or the path of the chosen Python interpreter's main executable in the `python` input.
    -Specify any other options you wish to save and reuse on all projects, if necessary by zooming in, and adding a custom input Param with each option's name.
    -Connect a true Boolean toggle to `go`.  An installation wide user options file (`config.toml`) will be created if there isn't one already.
    -To save options to other project specific `config.toml` files, specify the file path in `save_to` and repeat the previous 4 sub steps.

14. If a newer version of sDNA is used in future with tools unknown to sDNA_GH at the time it was built, if a Config component is placed, and the path of the new sDNA specified in `sDNA_folders`, sDNA_GH will attempt to automatically build components and user objects for the new sDNA tools, and add them to Grasshopper for you.  Set `make_new_comps` to false to prevent this.


### Usage.  
#### Tools.
Each tool has a component that runs that tool.  `auto_` rules may cause a component to also run other tools as well.  
For example, by default, sDNA components run Write_Shp before, and Read_Shp after, their sDNA tool. 

##### Common component input and output Params
**OK** This output is true when a component has executed successfully.

**go** Set this input to true (e.g. from a boolean toggle component) to run a component's tool.

**file** Specifies the path of a file to write to, or that was written to.

**Data**
It is possible to do most tasks in sDNA_GH without ever looking at `Data` in detail.  The order of the deepest branches must correspond with the order of the Geometric objects.  But for example to specify weights elsewhere than on their corresponding Polylines, it is also possible to construct `Data` manually.  If so, `Data` must be a Data Tree 2 branches deep at the first level: a branch each for keys {0;0} and values {0;1}.  The two nodes of this structure should have a branch for each geometric object (so the nth's keys and values should have paths {0;0;n} and {0;1;n}).  The lists at these nodes must be of equal length.  The mth key and value of the nth geometric object should be {0;0;n}[m] and {0;1;n}[m] respectively.  Read_Shp supplies a Data Tree in this required format, if the data is read from User Text or from a Shapefile.  Grasshopper's path tools can be used to adjust compatible Data Trees into this format.  

**Geom** Accepts a list of geometric objects (Guids of Rhino objects or native Grasshopper objects).  Data trees of objects need to be flattened into lists. To use Rhino objects referenced from Grasshopper parameter objects (instead of their Grasshopper versions which are often obscured unless the Rhino shapes are set to Hidden) run the output of the Geometry (Geo) or Curve (Crv) through a Guid (ID) parameter object first. 

**gdm** An alternative to both **Geom** and **Data**.  Accepts a Geometry-data-mapping, a list of nested dictionaries (standard Python objects).  The keys are the UUIDs of geometric objects.  The values are also dictionaries, containing key/value pairs for use as User Text.

**opts** Accepts an options data structure (a nested dictionary of named tuples) from another sDNA_GH component.  Only of use if they are not synced to the global module options.

**config** The path of a TOML file (e.g. `config.toml`) to be read in containing sDNA_GH options settings. Shared between synchronised components.

##### Support tools
###### Config (config)
Loads custom user options and configuration files (`.toml`).  Saves options to a `.toml` file if go is true.  If a `.toml` file is specified in `save_to`, it is saved to.  Otherwise the default value of `save_to` is the installation-wide user options file.  One is created if it does not already exist.  This will overwrite existing files.

If not using a `config.toml` file, then e.g. when using a config component to set true `auto_` options, to guarantee your components are setup correctly when reloading a saved `.gh` file, this component must run before all your others.  To ensure a component runs first, select it and press `Ctrl` + `B` (or from the pull-down menu select `Edit` -> `Arrange` -> `Put To Back`) before saving the `.gh` file.



###### Read_Geom (get_Geom)
Gets real strings of the uuid references to Rhino polylines and degree-1 Nurbs curves for subsequent sDNA_GH tools.  Grasshopper Geom and Curve params create Grasshopper references to Rhino objects.  The actual Rhino uuid is required to read and write User Text on a
Rhino object.

Set `selected` to true, to only read objects that are selected.  Similarly, specify `layer` to the name of a layer, to only read objects from that layer.  

Note, if `sync = True` it will remember its previous setting, in which case to go back to selecting all layers, `layer` must be set to any value that is not the name of a layer.  Similarly, to go back to selecting everything (not just selected geometry) set `selected = false`.  If the component has `sync = false`, an input Params that has had its value set, when subsequently disconnected will fallback to whatever its previous value was. 




##### Shapefile tools
###### Write_Shp (write_shapefile)
Writes a DataTree in `Data` and a list of polylines in `Geom` to a shapefile.  If not specified in `file`, a default file name based on the Rhino doc or Grasshopper doc name is used (unless `auto_update_Rhino_doc_path = false`).  `overwrite_shp` = true overwrites existing files, otherwise if it is false Write_Shp creates new automatically named files up to a maximum of `max_new_files` (20 by default).  **WARNING!  Shapefiles created with default names (due to no valid file path being specified in `file` by the user) will be deleted by subsequent sDNA tools if `strict_no_del` = false, `overwrite_shp` = false, and `del_after_sDNA` = true.**  

To create a projection (.prj) file for the new shapefile, specify the path of an existing .prj file in `prj`.  

If no Data is supplied, if no read_User_Text component is connected to its input, and if `auto_read_User_Text` is true, this tool will first call read_User_Text.  

To work with sDNA, data records are only written to the Shapefile (associated with a shape corresponding to a Rhino / GH polyline) if its field matches the template string specified in `input_key_str`.  The field name has a maximum of 10 characters long, and is taken from the `{name}` value (in the key name if it originated as User Text). To write all data with any key name (shorter then 11 characters) to the Shapefile, set `input_key_str` to `{name}`.  

Shapefile data entries (records) only allow a maximum width of 254 Ascii characters, or 254 bytes for Unicode strings.  Encodings can require more than one byte per code point.  So some UTF-8 and UTF-16 encoded Unicode strings may only be 120 code points long, or even shorter.  
This is an intrinsic limitation of the shapefile format [https://en.wikipedia.org/wiki/Shapefile#Data_storage].  

Rhino and Grasshopper shapes must support certain methods (to retrieve the points list of their vertices) to be written to shp files of the following types: `PolylineVertices` for `POLYLINE`s and `POLYGON`s, `PointCoordinates` for `POINT`s, `PointCloudPoints` for `MULTIPOINT`, and `MeshVertices` for `MULTIPATCH`.  Please note:  `MULTIPATCH`s are not supported, and `POINT`s and `MULTIPOINT`s are experimental and untested.

Write_Shp attempts to coerce data types to set the Shapefile field type and size correctly.  The full coercion order is bool -> int -> (float / Decimal) -> Date -> string (Shapefile field types L -> N -> F -> D -> C respectively).  If attempts at boolean and integer conversion fail, by default the data is then coerced to a Decimal.  The number of significant figures for 
Decimals is 12 by default.  This can be altered in `precision`.  If `decimal` is set to 
false, Write_Shp coerces the value to a float instead of a Decimal object.  The maximum number of decimal places is `max_dp`.
Dates are attempted to be built using Python's `datetime.date` object.  If a datetime.date cannot be built, if `yyyy_mm_dd` is true, a date must be in yyyy mm dd format.  Otherwise if `yyyy_mm_dd` is false as it is by default, dd mm yyyy and mm dd yyyy are also supported.  In both cases, the supported separators are one of: -.,:/\ or a single space.


###### Read_Shp (read_shapefile)
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""")
