# Grasshopper definition sDNA_GH_builder.gh (Grasshopper 1.0.7)
# plug-ins: MetaHopper

# ---- group: Metahopper Clone Objects
knob = ControlKnob(Decimals=0, Limit=False, Maximum=10, Minimum=0, Range=10, Value=3)
series = Series(Start=0, Step=1, Count=knob)
X = UnitX(Factor=Slider(304.332, range=-1000..750))
multiplication = Multiplication(A=Slider(46.512, range=0..100), B=series)
Y = UnitY(Factor=multiplication)
addition = Addition(A=Y, B=X)
selobj = GetSelectedObjects()  # -> ComponentObjects, ParamObjects, OtherObjects
create = InstantiateObject(Run=Toggle(False), Object=selobj.ComponentObjects, Location=addition)

# ----
geo = Geometry([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])
path = FilePath("C:\Users\James\Documents\Rhino\Grasshopper\sDNA\source\repos\GHsDNAv0.01\GHsDNA\GHsDNA\GHsDNA_launcher.py")
# 1) read_Usertext
# 2) read_shapes_and_data_from_shapefile
# 3) write_objects_and_data_to_shapefile
# 4) write_data_to_Usertext
# 5) bake_and_write_data_as_Usertext_to_Rhino
# 6) parse_data
# 7) recolour_objects
# 8) plot_data_on_Rhino_objects
# 9) get_objects_from_Rhino
# 10) sDNA_general
# 11) sDNAIntegral  :  Analysis
# 12) sDNASkim  :  Analysis
# 13) sDNAIntegralFromOD  :  Analysis
# 14) sDNAGeodesics  :  Analysis geometry
# 15) sDNAHulls  :  Analysis geometry
# 16) sDNANetRadii  :  Analysis geometry
# 17) sDNAAccessibilityMap  :  Analysis
# 18) sDNAPrepare  :  Preparation
# 19) sDNALineMeasures  :  Preparation
# 20) sDNALearn  :  Calibration
# 21) sDNAPredict  :  Calibration
# 22) Python : Dev tools ✓
path_2 = FilePath("C:\Users\James\Documents\Rhino\Grasshopper\temp.shp")
file = ReadFile(File=path, PerLineParse=False)
write_shp = GhPythonScript(go=Toggle(True), Geom=geo, f_name=path_2)  # -> out, OK, Data, Geom, gdm, f_name, opts, l_metas; inputs go: list of Boolean, Data: tree, Geom: list, f_name: list
# ---------- write_shp: Python ----------
#! /usr/bin/python2.7
# -*- coding: utf-8 -*-
__author__ = 'James Parrott'
__version__ = '0.01'



GHsDNA_subfolder = 'GHsDNA' 
GHsDNA_package = 'GHsDNA'               
reload_config_and_other_modules_if_already_loaded = False
GHsDNA_search_paths = [r'C:\Users\James\Documents\Rhino\Grasshopper\sDNA\source\repos\GHsDNAv0.01\GHsDNA']

#######################################################################################################################
# Please note!
# 
#
component_tool = None    # Note to user, if you rename this component in Grasshopper, 
                                        # EITHER: add an entry in name_map dictionary below from the name you've
                                        # given it to the name of the tool you want
                                        # this component to actually run.
                                        # 
                                        # OR: hardcode component_tool here to the name in support_component_names,
                                        # special_names, names_map, or in sDNA_tool_names, of the tool you want 
                                        # and make sure metas.allow_components_to_change_type_on_rename == False
                                        # Abbreviations are supported via the name_map dictionary below
                    #Abbreviation = Tool Name
name_map = dict(    sDNA_Demo = [ 'Read_From_Rhino'
                                 ,'Read_Usertext'
                                 ,'Write_Shp'
                                 ,'sDNAIntegral'
                                 ,'Read_Shp'
                                 ,'Write_Usertext'
                                 ,'Parse_Data'
                                 ,'Recolour_objects'
                                 ]
                    ,sDNA_Demo_old_plot = [
                                  'Read_From_Rhino'
                                 ,'Read_Usertext'
                                 ,'Write_Shp'
                                 ,'sDNAIntegral'
                                 ,'Read_Shp'
                                 ,'Write_Usertext'
                                 ,'Visualise_Data'
                                 ]
                    ,Read_From_Rhino = 'get_objects_from_Rhino'
                    ,Read_Usertext = 'read_Usertext'
                    ,Write_Shp = 'write_objects_and_data_to_shapefile'
                    ,Read_Shp = 'read_shapes_and_data_from_shapefile'
                    ,Write_Usertext = 'write_data_to_Usertext'
                    ,Bake_UserText = 'bake_and_write_data_as_Usertext_to_Rhino'
                    ,Visualise_Data = 'plot_data_on_Rhino_objects'
                    ,Parse_Data = 'parse_data'
                    ,Recolour_objects='recolour_objects'
                    ,Recolor_objects ='recolour_objects'
                    #,'main_sequence'
                    #,'sDNAIntegral'
                    #,'sDNASkim'
                    ,sDNAIntFromOD = 'sDNAIntegralFromOD'
                    #,'sDNAGeodesics'
                    #,'sDNAHulls'
                    #,'sDNANetRadii'
                    ,sDNAAccessMap = 'sDNAAccessibilityMap'
                    #,'sDNAPrepare'
                    #,'sDNALineMeasures'
                    #,'sDNALearn'
                    #,'sDNAPredict'
                )
#######################################################################################################################



import os,sys 
from os.path import isfile, isdir, join, split, dirname
from importlib import import_module

from ghpythonlib.componentbase import executingcomponent as component
import Grasshopper, GhPython
import System
import Rhino
import rhinoscriptsyntax as rs
import scriptcontext as sc
import ghpythonlib.treehelpers as th


def output(s, level='INFO', inst = None):        # e.g. inst is a MyComponent.  
                         # Inst is a proxy argument for both 'self' and 'cls'.
    #type: (str, MyComponent, str) -> None
    message = s
    if hasattr(inst,'nick_name'):
        message = inst.nick_name + ' : ' + message
    message_with_level = level + ' : ' + message
    #print(message_with_level)
    try:
        GHsDNA.tools.output("From GHsDNA_launcher: " + message, level, inst)
    except:
        try:
            getattr(GHsDNA.tools.wrapper_logging.logging,level.lower())("From GHsDNA_launcher via logging: " + message)
        except:
            print(message_with_level)
            if hasattr(inst,'a') and hasattr(inst.a,'write'):
                inst.a.write("From GHsDNA_launcher via inst: " + message_with_level)
    return message_with_level

def strict_import(  module_name = ''
                   ,folder = ''
                   ,sub_folder = ''
                   ,output = output
                  ):

    # type: (str,str,str,function) -> type[any]
    #
    if module_name == '':
        output('No module to import','INFO')
        return None
    output(module_name,'DEBUG')
    if module_name in sys.modules:   # sys.modules is also shared between GHPython components 
                                    # and is even saved until Rhino is closed.
        output('Module ' + module_name + ' already in sys.modules.  ','DEBUG')
        if reload_config_and_other_modules_if_already_loaded:
            output('Reloading ' +  module_name  + '.... ','DEBUG')
            reload(sys.modules[module_name]) # type: ignore
        return sys.modules[module_name]
    #
    #
    # Load module_name for first time:
    #
    #
    search_path = join(folder,sub_folder)
    output("Search path == " + search_path,'DEBUG')
    tmp = sys.path
    sys.path.insert(0, search_path)
    m = import_module(module_name, '')           
    sys.path = tmp
    return m       


class GHsDNA():
    pass


def load_modules(m_names, path_lists):
    m_names = m_names if isinstance(m_names, tuple) else [m_names]  # Need this one to be immmutable, so it's hashable to use as a dict key
    output('m_names == ' + str(m_names) + ' of type : ' + type(m_names).__name__,'DEBUG')
    if any((name.startswith('.') or name.startswith('..')) in name for name in m_names):
        output(m_names,'DEBUG')
        raise ImportError( output('Relative import attempted, but not supported','CRITICAL') )

    output('Testing paths : ' + '\n'.join(map(str,path_lists)),'DEBUG')
    output('Type(path_lists) : ' + type(path_lists).__name__,'DEBUG')


    for path_list in path_lists:
        test_paths = path_list if isinstance(path_list, list) else [path_list]
        test_paths = test_paths[:]
        #output('Type(path_list) : ' + type(path_list).__name__,'DEBUG')
        #output('Type(test_paths) : ' + type(test_paths).__name__,'DEBUG')

        for path in test_paths:
            output('Type(path) : ' + type(path).__name__ + ' path == ' + path,'DEBUG')
            if isfile(path):
                path = dirname(path)
            if all(any(isfile(join(path, name.replace('.', os.sep) + ending)) 
                        for ending in ['.py','.pyc'] )
                            for name in m_names):
                # We haven't checked every folder in a package has an __init__.py
                output('Importing ' + str(m_names) +' ','DEBUG')
                return tuple(strict_import(name, path, '') for name in m_names) + (path,)
    return None



def is_file_any_type(s):
    return isinstance(s, str) and isfile(s)

class MyComponent(component):

    global GHsDNA, GHsDNA_search_paths, component_tool, log_file
    GHsDNA_search_paths += [join(Grasshopper.Folders.DefaultAssemblyFolder
                                ,GHsDNA_subfolder
                                ) 
                            ]
                          
    GHsDNA.tools, GHsDNA_path = load_modules('GHsDNA.tools'
                                             ,GHsDNA_search_paths)

    opts = GHsDNA.tools.opts   # mutable.  Reference breakable and remakeable 
                               # to de sync / sync local opts to global opts
    local_metas = GHsDNA.tools.local_metas   # immutable.  controls syncing /
                                             # desyncing / read / write of the
                                             # above, opts.
                                             # Although local, can be set on 
                                             # groups of components using the 
                                             # default section of a project 
                                             # config.ini, or passed as a
                                             # Grasshopper parameter between
                                             # components
    tools_dict = GHsDNA.tools.tools_dict

  
    class_logger_name = "MyComponent"
    if GHsDNA.tools.logger.__class__.__name__ == 'WriteableFlushableList':
        log_file = (  ghdoc.Path.rpartition('.')[0]  #type: ignore
                    + opts['options'].log_file_suffix + '_tracker1'
                    + '.log' ) 
        log_file_dir = split(log_file)[0]
        if isdir(log_file_dir):
            GHsDNA.tools.logger = GHsDNA.tools.wrapper_logging.new_Logger( 
                                            'GHsDNA'
                                            ,log_file 
                                            ,opts['options'].logger_file_level
                                            ,opts['options'].logger_console_level
                                            )
        else:
            pass
            output('Invalid log file dir ' + log_file_dir + ' ', 'ERROR')

    logger = GHsDNA.tools.logger #.getChild( class_logger_name)
   


    my_tools = None

    def update_tools(self):
        self.my_tools = GHsDNA.tools.tool_factory( self.nick_name
                                                  ,name_map
                                                  ,self.opts)
        output('My_tools ==\n'
                +'\n'.join([tool.func_name for tool in self.my_tools])
                ,'DEBUG')


    def update_name(self):
        global name_map
        
        self.nick_name = ghenv.Component.NickName if component_tool==None else component_tool # type: ignore
        self.logger = self.logger.getChild(self.nick_name)
        self.update_tools()


        
    def update_sDNA(self):
        output('Self has attr sDNA == ' + str(hasattr(self,'sDNA'))+' ','DEBUG')
        output('self.opts[metas].sDNA == (' + str(self.opts['metas'].sDNAUISpec)
                + ', ' + self.opts['metas'].runsdna + ') ','DEBUG')

        if hasattr(self,'sDNA'):
            output('Self has attr sDNA == ' + str(hasattr(self,'sDNA'))+' ','DEBUG')
        
        sDNA = ( self.opts['metas'].sDNAUISpec  # Needs to be hashable to be
                ,self.opts['metas'].runsdna )   # a dict key => tuple not list

        if not hasattr(self,'sDNA') or self.sDNA != sDNA:
            self.UISpec, self.run, path = load_modules(sDNA, self.opts['metas'].sDNA_search_paths)

            output('Self has attr UISpec == ' + str(hasattr(self,'UISpec'))+' ' , 'DEBUG')
            output('Self has attr run == ' + str(hasattr(self,'run'))+' ' ,'DEBUG')

            self.sDNA = sDNA
            self.sDNA_path = path
            self.opts['metas'] = self.opts['metas']._replace(    sDNA = self.sDNA
                                                                ,sDNA_path = path 
                                                             )
            self.opts['options'] = self.opts['options']._replace(  UISpec = self.UISpec
                                                                  ,run = self.run 
                                                                  )  

            assert self.opts['metas'].sDNA_path == dirname(self.opts['options'].UISpec.__file__)                                                                  






    def __init__(self):

        
        self.a = GHsDNA.tools.WriteableFlushableList()
        GHsDNA.tools.wrapper_logging.add_custom_file_to_logger( self.logger
                                                               ,self.a
                                                               ,self.opts['options'].logger_custom_level)

        #runsdnacommand, sDNAUISpec = load_sDNA(options)


        self.update_sDNA()
        self.update_name()

        component.__init__(self)

  



    #GHsDNA = strict_import('GHsDNA', join(Grasshopper.Folders.DefaultAssemblyFolder,'GHsDNA'), sub_folder = 'GHsDNA')   
                                        # Grasshopper.Folders.AppDataFolder + r'\Libraries'
                                        # %appdata%  + r'\Grasshopper\Libraries'
                                        # os.getenv('APPDATA') + r'\Grasshopper\Libraries'
    def RunScript(self, go, Data, Geom, f_name, *args):
        # type (bool, str, Rhino Geometry, datatree, tuple(namedtuple,namedtuple), *dict)->bool, str, Rhino_Geom, datatree, str
        #if not 'opts' in globals():
        #    global opts
        if f_name and not isinstance(f_name, str) and isinstance(f_name, list):
            f_name=f_name[0]
        self.a = GHsDNA.tools.WriteableFlushableList() #Reset. Discard output persisting from previous calls to this method (should be logged anyway).
        options = self.opts['options']

        args_dict = {key.Name : val for key, val in zip(ghenv.Component.Params.Input[1:], args) } # type: ignore
        
        external_opts = args_dict.get('opts',{})
        external_local_metas = args_dict.get('local_metas',{})
        gdm = args_dict.get('gdm',{})

        #print('#1 self.local_metas == ' + str(self.local_metas))
        
        if self.nick_name != ghenv.Component.NickName:  # type: ignore
            self.update_name()
            output( ' Tools in ' + self.nick_name + ' changed to : ' 
                            + str(self.my_tools), 'WARNING' )
        
        
        synched = self.local_metas.sync_to_shared_global_opts
        old_sDNA = self.opts['metas'].sDNA

        #print('#1.05 self.local_metas == ' + str(self.local_metas))

        #if not self.local_metas.sync_to_shared_global_opts and self.local_metas.read_from_shared_global_opts:
        #    self.opts = GHsDNA.tools.opts.copy() 
        
        self.local_metas = GHsDNA.tools.override_all_opts( args_dict 
                                                          ,self.opts # also mutates self.opts; local_metas immutable
                                                          ,external_opts 
                                                          ,self.local_metas 
                                                          ,external_local_metas
                                                          ,self.nick_name)
        #output('#2 self.local_metas == ' + str(self.local_metas),'DEBUG')
        
        if (self.opts['metas'].auto_update_Rhino_doc_path 
            and not isfile(self.opts['options'].Rhino_doc_path)):
            path = Rhino.RhinoDoc.ActiveDoc.Path
            if not isinstance(path, str) or not isfile(path):
                path = ghdoc.Path #type: ignore
            self.opts['options'] = self.opts['options']._replace(
                                                    Rhino_doc_path = path)

        if self.opts['metas'].allow_components_to_change_type: 
            #assert False
            
            if self.local_metas.sync_to_shared_global_opts != synched:
                self.opts = GHsDNA.tools.opts if self.local_metas.sync_to_shared_global_opts else self.opts.copy()

            if self.opts['metas'].sDNA != old_sDNA:
                self.update_sDNA()
                self.update_tools()

                
        #load_GHsDNA()
        #reload(tools)
        
        #y = globals().copy(); 
        #print([x for x in y if not x.startswith('__') ])        
        #z = locals().copy();
        #print([x for x in z if not x.startswith('__') ])
        #
        #
        ############################################################################################
        # TODO: Wrap sDNAPrepare, to map subprocess.returncode to True if 1
        # Check with Crispin if return code 0 means preparation was successful, or just successful execution.
        # And if we have to delete groups based on deletion flag or can leave that to sDNA
        ############################################################################################
        #
        Defined_tools = [y for z in self.tools_dict.values() for y in z]
        Undefined_tools = [x for x in self.my_tools if x not in Defined_tools]

        if Undefined_tools:
            output('Defined_tools == ' + str(Defined_tools), 'DEBUG')
            output('Undefined tools == ' + str(Undefined_tools), 'DEBUG')
            raise ValueError(output('Tool function not in cache, possibly ' 
                                    + 'unsupported.  Check input tool_name '
                                    +'if sDNAGeneral, else tool_factory '
                                    ,'ERROR',self))


        if go in [True, [True]]: # [True] in case go set to List Access in GH component but only connected to a normal boolean
            returncode = 999
            assert isinstance(self.my_tools, list)

            output('my_tools == '+str(self.my_tools),'DEBUG')

            geom_data_map = GHsDNA.tools.convert_Data_tree_and_Geom_list_to_gdm(Geom, Data, self.opts)
            
            output('geom_data_map == '+str(type(geom_data_map)),'DEBUG')

            geom_data_map = GHsDNA.tools.override_gdm_with_gdm(gdm, geom_data_map, self.opts)

            output('After merge geom_data_map == '+str(type(geom_data_map)),'DEBUG')


            returncode, ret_f_name, gdm, a = GHsDNA.tools.run_tools(self.my_tools, f_name, geom_data_map, self.opts)
            print (str(gdm))
            if isinstance(gdm, dict):
                (NewData, Geometry) = (
                  GHsDNA.tools.convert_dictionary_to_data_tree_or_lists(gdm)
                                      )                
            else:
                NewData, Geometry = None, None

            ret_vals = (returncode==0), NewData, Geometry, ret_f_name, [gdm], a, [self.opts.copy()], [self.local_metas]
            #ret_vals = (returncode==0), NewData, Geometry, ret_f_name, a 

            if self.my_tools[-1] == GHsDNA.tools.parse_data:
                ret_vals = (ret_vals[0], self.opts['options'].plot_min, self.opts['options'].plot_max) + ret_vals[1:]

            return ret_vals
                                         #In Python 3 .keys() returns a dictview not a list
        else:   
            #return False, Data, Geom, f_name, self.a #, self.opts.copy(), self.local_metas
            return False, Data, Geom, f_name, [gdm], self.a, [self.opts.copy()], [self.local_metas]
# ---------- end write_shp ----------
sdna_demo = GhPythonScript(go=Toggle(False))  # -> OK, f_name, Geom, Data, a, opts; disabled
# ---------- sdna_demo: Python ----------
#! /usr/bin/python2.7
# -*- coding: utf-8 -*-
__author__ = 'James Parrott'
__version__ = '0.01'
 


GHsDNA_subfolder = 'GHsDNA'   
GHsDNA_package = 'GHsDNA'                
reload_config_and_other_modules_if_already_loaded = False 
GHsDNA_search_paths = [r'C:\Users\James\Documents\Rhino\Grasshopper\sDNA\source\repos\GHsDNAv0.01\GHsDNA']

#######################################################################################################################
# Please note!
#  
#
component_tool = None    # Note to user, if you rename this component in Grasshopper, 
                                        # EITHER: add an entry in name_map dictionary below from the name you've
                                        # given it to the name of the tool you want
                                        # this component to actually run.
                                        # 
                                        # OR: hardcode component_tool here to the name in support_component_names,
                                        # special_names, names_map, or in sDNA_tool_names, of the tool you want 
                                        # and make sure metas.allow_components_to_change_type_on_rename == False
                                        # Abbreviations are supported via the name_map dictionary below
                    #Abbreviation = Tool Name
name_map = dict(    sDNA_Demo = [ 'Read_From_Rhino'
                                 ,'Read_Usertext'
                                 ,'Write_Shp'
                                 ,'sDNAIntegral'
                                 ,'Read_Shp'
                                 ,'Write_Usertext'
                                 ,'Parse_Data'
                                 ,'Recolour_objects'
                                 ]
                    ,sDNA_Demo_old_plot = [
                                  'Read_From_Rhino'
                                 ,'Read_Usertext'
                                 ,'Write_Shp'
                                 ,'sDNAIntegral'
                                 ,'Read_Shp'
                                 ,'Write_Usertext'
                                 ,'Visualise_Data'
                                 ]
                    ,Read_From_Rhino = 'get_objects_from_Rhino'
                    ,Read_Usertext = 'read_Usertext'
                    ,Write_Shp = 'write_objects_and_data_to_shapefile'
                    ,Read_Shp = 'read_shapes_and_data_from_shapefile'
                    ,Write_Usertext = 'write_data_to_Usertext'
                    ,Bake_UserText = 'bake_and_write_data_as_Usertext_to_Rhino'
                    ,Visualise_Data = 'plot_data_on_Rhino_objects'
                    ,Parse_Data = 'parse_data'
                    ,Recolour_objects='recolour_objects'
                    ,Recolor_objects ='recolour_objects'
                    #,'main_sequence'
                    #,'sDNAIntegral'
                    #,'sDNASkim'
                    ,sDNAIntFromOD = 'sDNAIntegralFromOD'
                    #,'sDNAGeodesics'
                    #,'sDNAHulls'
                    #,'sDNANetRadii'
                    #,'sDNAAccessibilityMap'
                    #,'sDNAPrepare'
                    #,'sDNALineMeasures'
                    #,'sDNALearn'
                    #,'sDNAPredict'
                )
#######################################################################################################################



import os,sys 
from os.path import isfile, isdir, join, split, dirname
from importlib import import_module

from ghpythonlib.componentbase import executingcomponent as component
import Grasshopper, GhPython
import System
import Rhino
import rhinoscriptsyntax as rs
import scriptcontext as sc
import ghpythonlib.treehelpers as th


def output(s, level='INFO', inst = None):        # e.g. inst is a MyComponent.  
                         # Inst is a proxy argument for both 'self' and 'cls'.
    #type: (str, MyComponent, str) -> None
    message = s
    if hasattr(inst,'nick_name'):
        message = inst.nick_name + ' : ' + message
    message_with_level = level + ' : ' + message
    #print(message_with_level)
    try:
        GHsDNA.tools.output("From GHsDNA output " + message, level, inst)
    except:
        try:
            getattr(GHsDNA.tools.wrapper_logging.logging,level.lower())("from logging " + message)
        except:
            print(message_with_level)
            if hasattr(inst,'a') and hasattr(inst.a,'write'):
                inst.a.write(message_with_level + " via inst")
    return message_with_level

def strict_import(  module_name = ''
                   ,folder = ''
                   ,sub_folder = ''
                   ,output = output
                  ):

    # type: (str,str,str,function) -> type[any]
    #
    if module_name == '':
        output('No module to import','INFO')
        return None
    output(module_name,'DEBUG')
    if module_name in sys.modules:   # sys.modules is also shared between GHPython components 
                                    # and is even saved until Rhino is closed.
        output('Module ' + module_name + ' already in sys.modules.  ','DEBUG')
        if reload_config_and_other_modules_if_already_loaded:
            output('Reloading ' +  module_name  + '.... ','DEBUG')
            reload(sys.modules[module_name]) # type: ignore
        return sys.modules[module_name]
    #
    #
    # Load module_name for first time:
    #
    #
    search_path = join(folder,sub_folder)
    output("Search path == " + search_path,'DEBUG')
    tmp = sys.path
    sys.path.insert(0, search_path)
    m = import_module(module_name, '')           
    sys.path = tmp
    return m       


class GHsDNA():
    pass


def load_modules(m_names, path_lists):
    m_names = m_names if isinstance(m_names, tuple) else [m_names]  # Need this one to be immmutable, so it's hashable to use as a dict key
    output('m_names == ' + str(m_names) + ' of type : ' + type(m_names).__name__,'DEBUG')
    if any((name.startswith('.') or name.startswith('..')) in name for name in m_names):
        output(m_names,'DEBUG')
        raise ImportError( output('Relative import attempted, but not supported','CRITICAL') )

    output('Testing paths : ' + '\n'.join(map(str,path_lists)),'DEBUG')
    output('Type(path_lists) : ' + type(path_lists).__name__,'DEBUG')


    for path_list in path_lists:
        test_paths = path_list if isinstance(path_list, list) else [path_list]
        test_paths = test_paths[:]
        #output('Type(path_list) : ' + type(path_list).__name__,'DEBUG')
        #output('Type(test_paths) : ' + type(test_paths).__name__,'DEBUG')

        for path in test_paths:
            output('Type(path) : ' + type(path).__name__ + ' path == ' + path,'DEBUG')
            if isfile(path):
                path = dirname(path)
            if all(any(isfile(join(path, name.replace('.', os.sep) + ending)) 
                        for ending in ['.py','.pyc'] )
                            for name in m_names):
                # We haven't checked every folder in a package has an __init__.py
                output('Importing ' + str(m_names) +' ','DEBUG')
                return tuple(strict_import(name, path, '') for name in m_names) + (path,)
    return None



def is_file_any_type(s):
    return isinstance(s, str) and isfile(s)

class MyComponent(component):

    global GHsDNA, GHsDNA_search_paths, component_tool, log_file
    GHsDNA_search_paths += [join(Grasshopper.Folders.DefaultAssemblyFolder
                                ,GHsDNA_subfolder
                                ) 
                            ]
                          
    GHsDNA.tools, GHsDNA_path = load_modules('GHsDNA.tools'
                                             ,GHsDNA_search_paths)

    opts = GHsDNA.tools.opts   # mutable.  Reference breakable and remakeable 
                               # to de sync / sync local opts to global opts
    local_metas = GHsDNA.tools.local_metas   # immutable.  controls syncing /
                                             # desyncing / read / write of the
                                             # above, opts.
                                             # Although local, can be set on 
                                             # groups of components using the 
                                             # default section of a project 
                                             # config.ini, or passed as a
                                             # Grasshopper parameter between
                                             # components
    tools_dict = GHsDNA.tools.tools_dict

  
    class_logger_name = "MyComponent"
    if GHsDNA.tools.logger.__class__.__name__ == 'WriteableFlushableList':
        log_file = (  ghdoc.Path.rpartition('.')[0]  #type: ignore
                    + opts['options'].log_file_suffix + '_tracker1'
                    + '.log' ) 
        log_file_dir = split(log_file)[0]
        if isdir(log_file_dir):
            GHsDNA.tools.logger = GHsDNA.tools.wrapper_logging.new_Logger( 
                                            'GHsDNA'
                                            ,log_file 
                                            ,opts['options'].logger_file_level
                                            ,opts['options'].logger_console_level
                                            )
        else:
            pass
            output('Invalid log file dir ' + log_file_dir + ' ', 'ERROR')

    logger = GHsDNA.tools.logger #.getChild( class_logger_name)
   


    my_tools = None

    def update_tools(self):
        self.my_tools = GHsDNA.tools.tool_factory( self.nick_name
                                                  ,name_map
                                                  ,self.opts)
        output('My_tools ==\n'
                +'\n'.join([tool.func_name for tool in self.my_tools])
                ,'DEBUG')


    def update_name(self):
        global name_map
        
        self.nick_name = ghenv.Component.NickName if component_tool==None else component_tool # type: ignore
        self.logger = self.logger.getChild(self.nick_name)
        self.update_tools()


        
    def update_sDNA(self):
        output('Self has attr sDNA == ' + str(hasattr(self,'sDNA'))+' ','DEBUG')
        output('self.opts[metas].sDNA == (' + str(self.opts['metas'].sDNAUISpec)
                + ', ' + self.opts['metas'].runsdna + ') ','DEBUG')

        if hasattr(self,'sDNA'):
            output('Self has attr sDNA == ' + str(hasattr(self,'sDNA'))+' ','DEBUG')
        
        sDNA = ( self.opts['metas'].sDNAUISpec  # Needs to be hashable to be
                ,self.opts['metas'].runsdna )   # a dict key => tuple not list

        if not hasattr(self,'sDNA') or self.sDNA != sDNA:
            self.UISpec, self.run, path = load_modules(sDNA, self.opts['metas'].sDNA_search_paths)

            output('Self has attr UISpec == ' + str(hasattr(self,'UISpec'))+' ' , 'DEBUG')
            output('Self has attr run == ' + str(hasattr(self,'run'))+' ' ,'DEBUG')

            self.sDNA = sDNA
            self.sDNA_path = path
            self.opts['metas'] = self.opts['metas']._replace(    sDNA = self.sDNA
                                                                ,sDNA_path = path 
                                                             )
            self.opts['options'] = self.opts['options']._replace(  UISpec = self.UISpec
                                                                  ,run = self.run 
                                                                  )  

            assert self.opts['metas'].sDNA_path == dirname(self.opts['options'].UISpec.__file__)                                                                  






    def __init__(self):

        
        self.a = GHsDNA.tools.WriteableFlushableList()
        GHsDNA.tools.wrapper_logging.add_custom_file_to_logger( self.logger
                                                               ,self.a
                                                               ,self.opts['options'].logger_custom_level)

        #runsdnacommand, sDNAUISpec = load_sDNA(options)


        self.update_sDNA()
        self.update_name()

        component.__init__(self)

  



    #GHsDNA = strict_import('GHsDNA', join(Grasshopper.Folders.DefaultAssemblyFolder,'GHsDNA'), sub_folder = 'GHsDNA')   
                                        # Grasshopper.Folders.AppDataFolder + r'\Libraries'
                                        # %appdata%  + r'\Grasshopper\Libraries'
                                        # os.getenv('APPDATA') + r'\Grasshopper\Libraries'
    def RunScript(self, go, f_name, Geom, Data, *args):
        # type (bool, str, Rhino Geometry, datatree, tuple(namedtuple,namedtuple), *dict)->bool, str, Rhino_Geom, datatree, str
        #if not 'opts' in globals():
        #    global opts
        #reload(GHsDNA.tools) # type: ignore
        self.a = GHsDNA.tools.WriteableFlushableList() #Reset. Discard output persisting from previous calls to this method (should be logged anyway).
        args_dict = {key.Name : val for key, val in zip(ghenv.Component.Params.Input[1:], args) } # type: ignore
        
        external_opts = args_dict.get('opts',{})
        external_local_metas = args_dict.get('local_metas',{})
        #print('#1 self.local_metas == ' + str(self.local_metas))
        
        if self.nick_name != ghenv.Component.NickName:  # type: ignore
            self.update_name()
            output( ' Tools in ' + self.nick_name + ' changed to : ' 
                            + str(self.my_tools), 'WARNING' )
        
        
        synched = self.local_metas.sync_to_shared_global_opts
        old_sDNA = self.opts['metas'].sDNA

        #print('#1.05 self.local_metas == ' + str(self.local_metas))

        #if not self.local_metas.sync_to_shared_global_opts and self.local_metas.read_from_shared_global_opts:
        #    self.opts = GHsDNA.tools.opts.copy() 
        
        self.local_metas = GHsDNA.tools.override_all_opts( args_dict 
                                                          ,self.opts # also mutates self.opts; local_metas immutable
                                                          ,external_opts 
                                                          ,self.local_metas 
                                                          ,external_local_metas
                                                          ,self.nick_name)
        #output('#2 self.local_metas == ' + str(self.local_metas),'DEBUG')
        
        if (self.opts['metas'].auto_update_Rhino_doc_path 
            and not isfile(self.opts['options'].Rhino_doc_path)):
            path = Rhino.RhinoDoc.ActiveDoc.Path
            if not isinstance(path, str) or not isfile(path):
                path = ghdoc.Path #type: ignore
            self.opts['options'] = self.opts['options']._replace(
                                                    Rhino_doc_path = path)

        if self.opts['metas'].allow_components_to_change_type: 
            #assert False
            
            if self.local_metas.sync_to_shared_global_opts != synched:
                self.opts = GHsDNA.tools.opts if self.local_metas.sync_to_shared_global_opts else self.opts.copy()

            if self.opts['metas'].sDNA != old_sDNA:
                self.update_sDNA()
                self.update_tools()

                
        #load_GHsDNA()
        #reload(tools)
        
        #y = globals().copy(); 
        #print([x for x in y if not x.startswith('__') ])        
        #z = locals().copy();
        #print([x for x in z if not x.startswith('__') ])
        #
        #
        ############################################################################################
        # TODO: Wrap sDNAPrepare, to map subprocess.returncode to True if 1
        # Check with Crispin if return code 0 means preparation was successful, or just successful execution.
        # And if we have to delete groups based on deletion flag or can leave that to sDNA
        ############################################################################################
        #
        Defined_tools = [y for z in self.tools_dict.values() for y in z]
        Undefined_tools = [x for x in self.my_tools if x not in Defined_tools]

        if Undefined_tools:
            output('Defined_tools == ' + str(Defined_tools), 'DEBUG')
            output('Undefined tools == ' + str(Undefined_tools), 'DEBUG')
            raise ValueError(output('Tool function not in cache, possibly ' 
                                    + 'unsupported.  Check input tool_name '
                                    +'if sDNAGeneral, else tool_factory '
                                    ,'ERROR',self))


        if go in [True, [True]]: # [True] in case go set to List Access in GH component but only connected to a normal boolean
            returncode = 999
            assert isinstance(self.my_tools, list)

            output('my_tools == '+str(self.my_tools),'DEBUG')

            geom_data_map = GHsDNA.tools.convert_Data_tree_and_Geom_list_to_gdm(Geom, Data, self.opts)

            returncode, ret_f_name, gdm, a = GHsDNA.tools.run_tools(self.my_tools, f_name, geom_data_map, self.opts)

            if isinstance(gdm, dict):
                NewData, Geometry = GHsDNA.tools.convert_dictionary_to_data_tree_or_lists(gdm)                

            return returncode==0, ret_f_name, Geometry, NewData, a, self.opts.copy(), self.local_metas
                                         #In Python 3 .keys() returns a dictview not a list
        else:   
            return False, f_name, Geom, Data, self.a
# ---------- end sdna_demo ----------
python = GhPythonScript()  # -> out, a
# ---------- python: Python ----------
#! /usr/bin/python2.7
# -*- coding: utf-8 -*-
__author__ = 'James Parrott'
__version__ = '0.00'
__copyright__ = 'Cardiff University'
__license__ = {  'Python standard library modules and ' : 'Python Software Foundation 2.7.18' # https://docs.python.org/2.7/license.html
                ,'wrapper_logging' : 'Python Software Foundation 2.7.18'
                ,'wrapper_pyshp' : 'MIT' # https://pypi.org/project/pyshp/ 
                ,'sDNAUISpec.py' : 'MIT' # https://github.com/fiftysevendegreesofrad/sdna_open/blob/master/LICENSE.md
                ,'everything else' : 'same as for sDNA ' # https://sdna.cardiff.ac.uk/sdna/legal-license/ 
               }
if x:
    component_names = {0:"Tommy",1:"Dicky",2:"Harry"}
    
    a = component_names[x]
    print a
# ---------- end python ----------
legend = Legend(Colour=sdna_demo.Data, Tags=sdna_demo.Geom, Rectangle=sdna_demo.f_name, LegendType=1)
rename = RenameObject()
panel = Panel(write_shp.out)
delete_ghsdna = Button()
update = Button()
python_2 = GhPythonScript(del_GHsDNA=delete_ghsdna, update=update)  # -> out, a
# ---------- python_2: Python ----------
#! /usr/bin/python2.7
# -*- coding: utf-8 -*-
__author__ = 'James Parrott'
__version__ = '0.00'
__copyright__ = 'Cardiff University'
__license__ = {  'Python standard library modules and ' : 'Python Software Foundation 2.7.18' # https://docs.python.org/2.7/license.html
                ,'wrapper_logging' : 'Python Software Foundation 2.7.18'
                ,'wrapper_pyshp' : 'MIT' # https://pypi.org/project/pyshp/ 
                ,'sDNAUISpec.py' : 'MIT' # https://github.com/fiftysevendegreesofrad/sdna_open/blob/master/LICENSE.md
                ,'everything else' : 'same as for sDNA ' # https://sdna.cardiff.ac.uk/sdna/legal-license/ 
               }

import sys, os, Grasshopper, logging
#print('\n'.join([key for key in sys.modules if 'sDNA' in key]))
#print('functools' in sys.modules)
print('Our packages and modules in sys.modules:')
print('\n'.join([key for key in sys.modules if 'sdna' in key.lower() and not '.' in key]))
#print os.getenv('APPDATA')
#print ghdoc.Path
#print Grasshopper.Folders.DefaultAssemblyFolder
#print Grasshopper.Folders.AppDataFolder
#print sys.argv[0]
#print("Classmethod found == " + str('classmethod' in __builtins__))
def is_imported(s):
    return s in sys.modules
if del_GHsDNA == True:
    if 'logging' in sys.modules:
        sys.modules['logging'].shutdown()
    shared_cached_modules_etc = sys.modules.copy().keys()
    for y in shared_cached_modules_etc:
        if 'sDNA' in y or y == 'runsdnacommand':
            del sys.modules[y]


        
print('GHsDNA imported == ' + str(is_imported('GHsDNA')))
print('GHsDNA.tools imported == ' + str(is_imported('GHsDNA.tools')))
print('sDNAUISpec imported == ' + str(is_imported('sDNAUISpec')))
print('runsdnacommand == ' + str(is_imported('runsdnacommand')))
if False: #is_imported('GHsDNA'):
    print sys.modules['GHsDNA'].__all__
    print dir(sys.modules['GHsDNA'])
    if is_imported('GHsDNA.tools'):
        print dir(sys.modules['GHsDNA.tools'])
    if hasattr(sys.modules['GHsDNA'],'third_party_python_modules'):
        print dir(sys.modules['GHsDNA'].third_party_python_modules)

#print sys.modules.keys()
#print os.getcwd()
#print sys.path[0]
#print 'a' in globals()
#a = "This is a!"
#print('\n'.join(dir(sys.modules['GHsDNA'].third_party_python_modules)))
# ---------- end python_2 ----------
python_3 = GhPythonScript()  # -> out, a
# ---------- python_3: Python ----------
#! /usr/bin/python2.7
# -*- coding: utf-8 -*-
__author__ = 'James Parrott'
__version__ = '0.00'
__copyright__ = 'Cardiff University'
__license__ = {  'Python standard library modules and ' : 'Python Software Foundation 2.7.18' # https://docs.python.org/2.7/license.html
                ,'wrapper_logging' : 'Python Software Foundation 2.7.18'
                ,'wrapper_pyshp' : 'MIT' # https://pypi.org/project/pyshp/ 
                ,'sDNAUISpec.py' : 'MIT' # https://github.com/fiftysevendegreesofrad/sdna_open/blob/master/LICENSE.md
                ,'everything else' : 'same as for sDNA ' # https://sdna.cardiff.ac.uk/sdna/legal-license/ 
               }

import ghpythonlib.treehelpers as th
import rhinoscriptsyntax as rs
import uuid
import scriptcontext as sc
import Rhino

s='de5b73ac-055b-494c-9efd-306c186ffaa3'
print (rs.IsObject(s) if uuid.UUID(s) else False)

print 'ghdoc' in globals()

#rs.AddPolyline([(0,0),(10,10)]) # Works

import sys
try:
    print sys.modules['logging'].logger
except:
    pass

#print dir(th.Tree)
#print isinstance(None, th.Tree)

sc.doc = Rhino.RhinoDoc.ActiveDoc

objs = rs.ObjectsByType(4)

#print rs.LinetypeNames()

#print type(objs[0])

#print dir(objs[0])

#print '\n'.join([str(obj) for obj in objs if rs.IsPolyline(obj)]) #objs[0].TopologyDescription
f = rs.IsObject
if objs:
    isobj = rs.IsObject(objs[0])
    print ["IsObject == " + str(f(obj))+'\n' for obj in [objs[0]]] 
    if isobj:
        iscurve = rs.IsCurve(objs[0])
        print "IsCurve == " + str(iscurve )
        if iscurve:
            isline = rs.IsLine(objs[0])
            print "IsLine == " + str(isline )        
            if isline:
                ispline = rs.IsPolyline(objs[0])
                print "IsPolyline == " + str(ispline )
    print rs.PolylineVertices(objs[0])

sc.doc = ghdoc
# ---------- end python_3 ----------
python_4 = GhPythonScript()  # -> out, a; disabled
# ---------- python_4: Python ----------
#! /usr/bin/python2.7
# -*- coding: utf-8 -*-
__author__ = 'James Parrott'
__version__ = '0.00'
__copyright__ = 'Cardiff University'
__license__ = {  'Python standard library modules and ' : 'Python Software Foundation 2.7.18' # https://docs.python.org/2.7/license.html
                ,'wrapper_logging' : 'Python Software Foundation 2.7.18'
                ,'wrapper_pyshp' : 'MIT' # https://pypi.org/project/pyshp/ 
                ,'sDNAUISpec.py' : 'MIT' # https://github.com/fiftysevendegreesofrad/sdna_open/blob/master/LICENSE.md
                ,'everything else' : 'same as for sDNA ' # https://sdna.cardiff.ac.uk/sdna/legal-license/ 
               }

import scriptcontext as sc
import sys
from os.path import join
from importlib import import_module

print dir(sys.modules['GHsDNA.custom_python_modules.wrapper_pyshp'])

del sys.modules['GHsDNA']


"""

def strict_import(  module_name = None
                   ,folder = ''
                   ,sub_folder = ''
                   ,pkg = None 
                   ,output = lambda s : sys.stdout.write(s + '\n')
                  ):

    # type: (str,str) -> module

    #
    if module_name == None:
        output('No module to import')
    else:
        if module_name in sc.sticky:   
            return sc.sticky[module_name]    # https://developer.rhino3d.com/guides/rhinopython/ghpython-global-sticky/
        elif module_name in sys.modules:   # sys.modules is also shared between GHPython components 
                                        # and is even saved until Rhino is closed.
            output('Module ' + module_name + ' already in sys.modules.  Reloading.... ')
            #if metas.reload_config_and_other_modules_if_already_loaded:
            try:
                reload(sys.modules[module_name])
                return sys.modules[module_name]
            except:
                output('Could not reload module ' + module_name)
                return None
        tmp = sys.path
        sys.path = [join(folder,sub_folder)]
        try:
            m = import_module(module_name, pkg)           
            sc.sticky[module_name] = m
        except:
            output('Module ' + module_name + ' not found in ' + '\n'.join(test_files)) #sys.path[0])
            m = 679.0
        finally:
            sys.path = tmp
            return m
            #TODO search sub folders and a few levels of parent folders
            #TODO attempt to download required .gh and other .py modules?        

strict_import('GHsDNA', r'C:\Users\James\Documents\Rhino\Grasshopper\sDNA\source\repos\GHsDNAv0.00\GHsDNA', '', 'GHsDNA')
GHsDNA = strict_import('.GHsDNA', r'C:\Users\James\Documents\Rhino\Grasshopper\sDNA\source\repos\GHsDNAv0.00\GHsDNA', 'GHsDNA', 'GHsDNA')
#tmp = sys.path
#sys.path = [join(r'C:\Users\James\Documents\Rhino\Grasshopper\sDNA\source\repos\GHsDNAv0.00\GHsDNA','')]
#print sys.path[0]
#import_module('GHsDNA', 'GHsDNA')
#from GHsDNA import GHsDNA
print dir(GHsDNA)

#sys.path = tmp
#print '\n'.join(sys.modules.keys())

"""
# ---------- end python_4 ----------
panel_2 = Panel(python_2.out)
