# Grasshopper definition Rhino_8_Read_Geom_(Rhino)_and_Recolour_Objects_test.gh (Grasshopper 1.0.8)
# plug-ins: RhinoCodePluginGH

# ---- group: Test fixture helper
min = Number(-123)
max = Number(173)
dom = ConstructDomain(DomainStart=min, DomainEnd=max)
random = Random(Range=dom, Number=1, Seed=2)
gradient = Gradient(
    LowerLimit=min,
    UpperLimit=max,
    Parameter=random,
    stops=[0: RGB(243, 57, 0), 0.1: RGB(236, 27, 60), 0.2: RGB(210, 0, 118), 0.3: RGB(103, 0, 120), 0.4: RGB(39, 72, 161), 0.5: RGB(1, 192, 229), 0.6: RGB(18, 178, 90), 0.7: RGB(79, 186, 8), 0.8: RGB(220, 237, 32), 0.9: RGB(247, 159, 20), 1: RGB(243, 57, 0)])

# ----
run_tests_ghpython = Unload_sDNA()  # -> out, cols, geom; disabled
# ---------- run_tests_ghpython: Python ----------
#! /usr/bin/awk NR==3
# -*- coding: utf-8 -*-
# This module requires Grasshopper Python (Rhino3D)

# MIT License 

# Copyright (c) [2021] [Cardiff University, a body incorporated
# by Royal Charter and a registered charity (number:
# 1136855) whose administrative offices are at 7th floor 30-
# 36 Newport Road, University CF24 0DE, Wales, UK] 

# Permission is hereby granted, free of charge, to any person obtaining a copy
# of this software and associated documentation files (the "Software"), to deal
# in the Software without restriction, including without limitation the rights
# to use, copy, modify, merge, publish, distribute, sublicense, and/or sell
# copies of the Software, and to permit persons to whom the Software is
# furnished to do so, subject to the following conditions:

# The above copyright notice and this permission notice shall be included in all
# copies or substantial portions of the Software.

# THE SOFTWARE IS PROVIDED "AS IS", WITHOUT WARRANTY OF ANY KIND, EXPRESS OR
# IMPLIED, INCLUDING BUT NOT LIMITED TO THE WARRANTIES OF MERCHANTABILITY,
# FITNESS FOR A PARTICULAR PURPOSE AND NONINFRINGEMENT. IN NO EVENT SHALL THE
# AUTHORS OR COPYRIGHT HOLDERS BE LIABLE FOR ANY CLAIM, DAMAGES OR OTHER
# LIABILITY, WHETHER IN AN ACTION OF CONTRACT, TORT OR OTHERWISE, ARISING FROM,
# OUT OF OR IN CONNECTION WITH THE SOFTWARE OR THE USE OR OTHER DEALINGS IN THE
# SOFTWARE.
        

__author__ = 'James Parrott'
__version__ = '3.0.0.alpha_1'
        
        
        
        
import sys
import os
import functools
import importlib

from ghpythonlib.componentbase import executingcomponent as component
import Grasshopper
import scriptcontext as sc

import_module = importlib.import_module
try:
    reload #type: ignore
except NameError:
    reload = importlib.reload

try:
    basestring #type: ignore
except NameError:
    basestring = str

try:
    ghdoc #type: ignore
except NameError:
    from .custom.skel.basic.ghdoc import ghdoc


ZIP_FILE_NAME = 'sdna-gh'
PACKAGE_NAME = 'sDNA_GH'
PLUG_IN_NAME = 'sDNA'               
RELOAD_IF_ALREADY_IMPORTED = False
REPOSITORY = os.path.dirname(os.path.dirname(ghdoc.Path)) if ghdoc.Path else None
# Assume we are in repo_folder/dev/sDNA_build_components.gh

USER_INSTALLATION_FOLDER = os.path.join(
                                    Grasshopper.Folders.DefaultUserObjectFolder
                                   ,ZIP_FILE_NAME
                                   )
SELFTEST = 'selftest'




class Output(object): 

    def set_logger(self, logger, flush = True):
        self.logger = logger
        if flush and self.tmp_logs:
            self.flush()

    def __init__(self
                ,tmp_logs = None
                ,logger = None
                ):
        if not isinstance(tmp_logs, list): #assert not isinstance(None, list)
            tmp_logs = []
        self.tmp_logs = tmp_logs
        self.set_logger(logger, flush = False)



    def store(self, message, logging_level):
        self.tmp_logs.append( (message, logging_level) )

    def __call__(self, message, logging_level = "INFO", logging_dict = {}):
        #type: (str, str, dict, list) -> str
        
        #logger.debug(s)

        if logging_dict == {} and self.logger is not None: 
            logging_dict = dict( DEBUG = self.logger.debug
                                ,INFO = self.logger.info
                                ,WARNING = self.logger.warning
                                ,ERROR = self.logger.error
                                ,CRITICAL = self.logger.critical
                                )

        logging_level = logging_level.upper()
        if logging_level in logging_dict:
            logging_dict[logging_level](message)
        else:
            self.store(message, logging_level)

        return '%s : %s ' % (logging_level, message)

    def __getattr__(self, attr):
        return functools.partial(self.__call__, logging_level = attr.upper())

    def flush(self):
        tmp_logs = self.tmp_logs[:] # __call__ might cache back to tmp_logs
        self.tmp_logs[:] = [] # Mutate list initialised with.  Avoid double 
                              # logging in case re - stored in tmp_logs
        for tmp_log_message, tmp_log_level in tmp_logs:
            self.__call__(tmp_log_message, tmp_log_level)

output = Output()

class InvalidArgsError(Exception):
    
    """Custom exception to log the error message, and to at least allow 
       attempts to give users actionable advice to fix the issue, in 
       the event of a problem.  
    """
    message_fmt = 'Invalid import args: %s'
    def __init__(self
                ,message_fmt = ''
                ,message = ''
                ,logger = output
                , **kwargs
                ):
        if message_fmt and isinstance(message_fmt, basestring):
            self.message_fmt = message_fmt
        if kwargs and (not message or not isinstance(message, basestring)):
            message = self.message_fmt % kwargs
        logger.error(message)
        self.kwargs = kwargs
        super(InvalidArgsError, self).__init__(message)    


class ModuleNameError(InvalidArgsError):
    message_fmt = 'Invalid module name: %s'


class FilePathError(InvalidArgsError):
    message_fmt = 'Invalid path to import module from: %s'


# We only know the sDNA version to import as a string.  This is more secure too.
def strict_import(module_name = ''
                 ,folder = ''
                 ,sub_folder = ''
                 ,logger = output
                 ,reload_already_imported = RELOAD_IF_ALREADY_IMPORTED
                 ):

    # type: (str, str, str, type[any], bool) -> type[any]
    """ Imports the named module from the specified folder\subfolder only, 
        and returns it.
        
        Avoids name clashes and casual hijack attempts.  In some 
        environments supporting a Python implementation (such as 
        GhPython in Grasshopper) it may not be desirable to ask the user 
        to set PYTHONPATH.  Hence here, we insert the specified folder
        into sys.path (if they are not already in there).
    """
    if not module_name or not isinstance(module_name, basestring):
        raise ModuleNameError(module_name = module_name
                             ,folder = folder
                             ,sub_folder = sub_folder
                             ,logger = logger
                             )
    logger.debug(module_name)
    if module_name in sys.modules:   # sys.modules is also shared between GHPython components 
                                     # (and is even saved until Rhino is closed).
        logger.debug('Module %s already in sys.modules' % module_name)
        if reload_already_imported:
            logger.debug('Reloading %s.... ' % module_name)
            reload(sys.modules[module_name]) # type: ignore
        return sys.modules[module_name]
    #
    #
    # Load module_name for first time:
    #
    #
    search_path = os.path.join(folder, sub_folder) 

    if (search_path 
        and isinstance(search_path, basestring) 
        and os.path.isdir(search_path)):
        #
        logger.debug('Search path == %s' % search_path)
        #if search_folder_only:
        #    sys.path = [search_path]
        if search_path not in sys.path:
            sys.path.insert(0, search_path)
    else:
        raise FilePathError(module_name = module_name
                           ,search_path = search_path
                           ,logger = logger
                           )

    logger.debug('Trying import... ')
    module = import_module(module_name, '')           

    return module       


class ModulesNotFoundError(InvalidArgsError):
    message_fmt = 'Modules not found in any location %s'


def load_modules(m_names
                ,folders
                ,logger = output
                ,module_name_error_msg = 'Please supply valid names of modules to import, %s'
                ,folders_error_msg = 'Please supply valid folders to import from. %s'
                ,modules_not_found_msg = 'Specified modules not found in any folder, %s'):
    #type(str/ Iterable, list, type[any], str, str) -> tuple / None
    """ Tries to import all modules in m_names, from the first folder in 
        folders to contain a .py or .pyc files with the same name as each 
        module.

        Returns a tuple of all the modules and the path they were found in.  Else 
        raises a ModulesNotFoundError.
    """
    if not m_names:
        raise ModuleNameError(message_fmt = 'No module names supplied, m_names = %s'
                             ,m_names = m_names
                             ,logger = logger
                             )

    if any( not isinstance(m_name, basestring) for m_name in m_names ):
        # if m_names is a basestring, the error is not raised 
        raise ModuleNameError(message_fmt = module_name_error_msg
                             ,m_names = m_names
                             ,logger = logger
                             )
    
    if isinstance(m_names, basestring):
        m_names = [m_names] 

    logger.debug('m_names == %s of type : %s' % (m_names, type(m_names).__name__))

    logger.debug('Testing paths : %s ' % folders)
    
    if isinstance(folders, basestring):
        folders = [folders]

    if not any(os.path.isdir(folder) or os.path.isdir(os.path.dirname(folder)) 
               for folder in folders
              ):
        raise FilePathError(message_fmt = folders_error_msg
                           ,m_names = m_names
                           ,logger = logger
                           )

    for folder in folders:
        logger.debug('Type(folder) : %s' % type(folder).__name__)
        logger.debug('Type(path) : %s path == %s' %(type(folder).__name__, folder))

        if os.path.isfile(folder):
            folder = os.path.dirname(folder)
        if all( any(os.path.isfile(os.path.join(folder, name.replace('.', os.sep) + ending)) 
                    for ending in ['.py','.pyc'] 
                   )
                for name in m_names
              ):
            #
            logger.debug('Importing %s' % repr(m_names))

            return tuple(strict_import(name, folder, '', logger = logger) 
                         for name in m_names
                        ) + (folder,)
            # tuple of modules, followed by the path to them
    raise ModulesNotFoundError(message_fmt = modules_not_found_msg
                              ,m_names = m_names
                              ,folders = folders
                              ,logger = logger
                              )


sDNA_GH_search_path = USER_INSTALLATION_FOLDER

load_modules(  m_names = PACKAGE_NAME + '.main'
              ,folders = sDNA_GH_search_path
              ,folders_error_msg = 'Please unzip %s.zip '
                                   %ZIP_FILE_NAME
                                   +' in the folder %s '
                                   %Grasshopper.Folders.DefaultUserObjectFolder
                                   +'and ensure a subfolder called %s is created '
                                   %os.path.join(ZIP_FILE_NAME, PACKAGE_NAME)
                                   +'inside it, containing main.py ' 
                                   +'and all the sDNA_GH python files '
                                   +'including those within other subfolders. ' 
              ,modules_not_found_msg = 'Some sDNA_GH files may be missing.  '
                                      +'Please: 1) Copy %s.zip into: %s '
                                      %(ZIP_FILE_NAME
                                       ,Grasshopper.Folders.DefaultUserObjectFolder
                                       )
                                      +'2) Unblock it if necessary. '
                                      +'3) Right click '
                                      +'it, select Extract All... and click Extract, '
                                      +'to extract it to that location. '
                                      +'4) Ensure that main.py and all sDNA_GH python' 
                                      +' files and subfolders are inside: %s '
                                      %os.path.join(USER_INSTALLATION_FOLDER
                                                   ,PACKAGE_NAME
                                                   )
                                      +'5) Reinitialise the component or restart Rhino.'
              )         


load_modules('%s.tests.unit_tests.%s_unit_tests' % ((PACKAGE_NAME,)*2)
                            ,sDNA_GH_search_path
                            )

#! python2

import os 
import time
import random
import inspect
import logging
from collections import OrderedDict
import unittest

import System

import scriptcontext as sc 
import Rhino
import Rhino.NodeInCode.Components
import Grasshopper
import rhinoscriptsyntax as rs
import ghpythonlib.treehelpers as th
from ghpythonlib.componentbase import executingcomponent as component 

from sDNA_GH.tests.unit_tests.sDNA_GH_unit_tests import make_noninteractive_test_running_component_class


def GH_doc_components(doc):
    return {component.NickName : component
            for component in doc.Objects
           }

def set_data_on(param, val):
    param.ClearData()
    param.AddVolatileData(Grasshopper.Kernel.Data.GH_Path(0), 0, val)

def get_data_from(param):
    branch = Grasshopper.DataTree[object](param.VolatileData).Branch(0)
    return branch[0] if branch else None


GH_Doc = ghdoc.Component.Attributes.DocObject.OnPingDocument()
GH_Doc_components = GH_doc_components(GH_Doc)

#all_docs_comps = {
#    os.path.splitext(os.path.basename(doc.FilePath))[0] : (doc, GH_doc_components(doc)) 
#    for doc in Grasshopper.Instances.DocumentServer.GetEnumerator() 
#    }





#info = Rhino.NodeInCode.Components.FindComponent('read')

#assert info


Recolour_Objects = GH_Doc_components['Recolour_Objects'] 

# print(type(Recolour_Objects))

def run_comp(comp, **kwargs):
    
    comp.ClearData()
    #    comp.ExpireSolution(False)
    for param in comp.Params.Input:
        if param.NickName in kwargs:
            set_data_on(param, kwargs[param.NickName])
    comp.CollectData()
    comp.ComputeData()
    
    return {param.NickName : get_data_from(param) 
            for param in comp.Params.Output
           }

#def run_Recolour_Objects(Data, Geom):
#    set_data_on(Recolour_Objects.Params.Input[0], True) #go
#    set_data_on(Recolour_Objects.Params.Input[4], Data) 
#    set_data_on(Recolour_Objects.Params.Input[5], Geom)

#    run_comp(Recolour_Objects, go=True, Data=Data, Geom=Geom)

    # a = get_data_from(Recolour_Objects.Params.Output[0])

    # print(a)


# cols = th.tree_to_list(colours)[0]

# print(len(cols[0]))

# random is used here for fuzz testing, not Cryptography.  
# But could Windows OS generated randomness be repeatable
# between instances of the same VM image, e.g. CI runners?  
# If so use:
# random.seed(time.time())
# Otherwise, assuming os.urandom includes the time already:
SEED = os.urandom(10)
random.seed(SEED)

# Extents of viewport
MIN_X, MAX_X, MIN_Y, MAX_Y = -10.0, 110.0, -10.0, 40.0

def random_number(min_ = MIN_X, max_ = MAX_X):
    return random.uniform(min_, max_)

def random_pair():
    return random_number(), random_number()

def random_triple():
    return random_pair() + (random_number(),)

def random_int(min_ = 2, max_ = 17):
    return random.randint(min_, max_)

def random_triples(n = None):
    n = n or random_int(min_ = 3)
    return tuple(random_triple() for __ in range(n))

# def random_point():

def random_nurbs_curve(length = None, degree = None):
    length = length or random_int()

    # The control points are a list of at least degree+1 points.
    # https://developer.rhino3d.com/guides/opennurbs/nurbs-geometry-overview/
    degree = degree or random_int(1, length-1)

    # The knots are a list of degree+N-1 numbers, where N is the number of control points. Sometimes this list of numbers is called the knot vector. In this term, the word vector does not mean 3‑D direction.
    # This list of knot numbers must satisfy several technical conditions. The standard way to ensure that the technical conditions are satisfied is to require the numbers to stay the same or get larger as you go down the list and to limit the number of duplicate values to no more than the degree. For example, for a degree 3 NURBS curve with 11 control points, the list of numbers 0,0,0,1,2,2,2,3,7,7,9,9,9 is a satisfactory list of knots. The list 0,0,0,1,2,2,2,2,7,7,9,9,9 is unacceptable because there are four 2s and four is larger than the degree.
    # The number of times a knot value is duplicated is called the knot’s multiplicity. In the preceding example of a satisfactory list of knots, the knot value 0 has multiplicity three, the knot value 1 has multiplicity one, the knot value 2 has multiplicity three, the knot value 3 has multiplicity one, the knot value 7 has multiplicity two, and the knot value 9 has multiplicity three. A knot value is said to be a full-multiplicity knot if it is duplicated degree many times. In the example, the knot values 0, 2, and 9 have full multiplicity. A knot value that appears only once is called a simple knot. In the example, the knot values 1 and 3 are simple knots.
    # If a list of knots starts with a full multiplicity knot, is followed by simple knots, terminates with a full multiplicity knot, and the values are equally spaced, then the knots are called uniform. For example, if a degree 3 NURBS curve with 7 control points has knots 0,0,0,1,2,3,4,4,4, then the curve has uniform knots. The knots 0,0,0,1,2,5,6,6,6 are not uniform. Knots that are not uniform are called non‑uniform. The N and U in NURBS stand for non‑uniform and indicate that the knots in a NURBS curve are permitted to be non-uniform.
    # Duplicate knot values in the middle of the knot list make a NURBS curve less smooth. At the extreme, a full multiplicity knot in the middle of the knot list means there is a place on the NURBS curve that can be bent into a sharp kink. For this reason, some designers like to add and remove knots and then adjust control points to make curves have smoother or kinkier shapes. Since the number of knots is equal to (N+degree‑1), where N is the number of control points, adding knots also adds control points and removing knots removes control points. Knots can be added without changing the shape of a NURBS curve. In general, removing knots will change the shape of a curve.
    knots = []

    i = 0
    while len(knots) < degree + length -1:
        multiplicity = random_int(1, degree)
        knots.extend([i,] * multiplicity)
        i += 1

    #
    points = random_triples(length)

    return rs.AddNurbsCurve(points, knots, degree) 

try:
    unichr
except NameError:
    unichr = chr

def random_string(length = None):
    length = length or random_int()
    return u''.join(unichr(random_int()) for __ in range(length))


OBJECT_GENERATORS = [rs.AddArc3Pt, rs.AddBox, rs.AddCircle3Pt, 
                     rs.AddCone, rs.AddCurve, rs.AddEllipse3Pt, rs.AddLine,
                     rs.AddPoint, rs.AddPolyline,
                     rs.AddRectangle, rs.AddSphere, rs.AddSpiral, rs.AddTorus,
                     rs.AddTextDot, random_nurbs_curve
                     ]

def needed_args(func):
    arg_spec = inspect.getargspec(func)
    if arg_spec.defaults is None:
        return arg_spec.args
    return arg_spec.args[:-len(arg_spec.defaults)]

#for obj_gen in OBJECT_GENERATORS:
#    break
#    print('%s: %s' % (obj_gen.__name__, needed_args(obj_gen)))

random_funcs = OrderedDict([
                     (('start', 'end', 'first', 'second', 'third', 'center'), random_triple),
                     (('points','corners'), random_triples),
                     (('point', ), random_triple),
                     (('plane','base'), lambda : rs.WorldXYPlane()),
                     (('height', 'width', 'radius', 'pitch'), random_number),
                     (('turns',), random_int),
                     (('text',), random_string),
                     ])


def random_Geometry():

    N = random_int(1, 14)

    Geom = []
    for __ in range(N):
        obj_gen = random.choice(OBJECT_GENERATORS)
        kwargs = {}
        for arg in needed_args(obj_gen):
            names_and_random_funcs = ((name, v) 
                                    for k, v in random_funcs.items()
                                    for name in k)
            for name, random_func in names_and_random_funcs:
                if name in arg:
                    kwargs[arg] = random_func()
                    break
                #
            else: # no break in inner most for loop - no name found
                raise KeyError('No random func found for arg: %s' % arg)
        try:
            geom = obj_gen(**kwargs)        
        except Exception:
            print('Oops! %s ' % [obj_gen.__name__, kwargs])
            continue
        if geom:
            Geom.append(str(geom))
    
    return Geom

def make_callable_using_node_in_code(name):
    func_info = Rhino.NodeInCode.Components.FindComponent(name);
    
    #    if (func_info == null) { Print("Error finding function"); return; }
    
    func = func_info.Delegate #as dynamic;


#def make_random_objects_random_colours_tester():

def test_recolouring_random_num_of_random_objs_random_cols(self):

    sc.doc = Rhino.RhinoDoc.ActiveDoc
    Geom = random_Geometry()

    N = len(Geom)

    cols = []

    GHRandomComponent = GH_Doc_components['Random']
    GHGradientComponent = GH_Doc_components['Gradient']
#    print('Grad.NickName: %s ' % GHGradientComponent.NickName)
#    print('Grad.Name: %s ' % GHGradientComponent.Name)

#    print([(Output.NickName, Output.Name) 
#           for Output in GHGradientComponent.Params.Output
#          ])


    # func = make_callable_using_node_in_code(name)
    
    for __ in range(N):

        #
#        I = [-123, 173, random_int(-123, 173)];
        #
#        result = func(*I);
        #
#        a = result[0]; #//this is output R
        
#        print(type(a))
        
#        cols.append(a)

#         randomise seed
#        set_data_on(GHRandomComponent.Params.Input[2], random_int())
#        set_data_on(GHRandomComponent.Params.Input[1], 1)

        random_retvals = run_comp(GHRandomComponent, N=1, S = random_int(0, 250000))

        gradient_retvals = run_comp(GHGradientComponent, L0=-123, L1 = 172, t = random_retvals['nums'])


        # print()
#        col = get_data_from(GHGradientComponent.Params.Output[0])
        col = gradient_retvals['C']
        cols.append(col.Value) #System.Drawing.Color(col))


    # print([dir(col.Value) for col in cols])
    # print([col.Value for col in cols])
    # print([isinstance(col.Value, System.Drawing.Color) for col in cols])
    # print([type(col.Value) for col in cols])
    # print([type(geom) for geom in Geom])

    # sc.doc = ghdoc
    # print()

    # cols = th.list_to_tree(cols)

    run_comp(Recolour_Objects, go=True, Data=cols, Geom=Geom)

    j = 0
    for geom, colour in zip(Geom, cols):
        guid = System.Guid(geom)
        j += 1
        if not guid:
            print('j: %s, Falsey guid: %s' % (j, guid))
            continue
        obj = Rhino.RhinoDoc.ActiveDoc.Objects.Find(guid)
        if not obj:
            print('j: %s, Falsey obj: %s' % (j, obj))
            continue
        if self is not None:
            self.assertEqual(obj.Attributes.ObjectColor, colour)
        print('%s: Correct colour: %s' % (guid, obj.Attributes.ObjectColor == colour))
      

class RandomNumberOfRandomObjectsRandomlyRecolourTests(unittest.TestCase):
    pass


NUM_TESTS = 5

method_names = []

for i in range(NUM_TESTS):
#    test_recolouring_random_num_of_random_objs_random_cols(None)
    method_name = 'test_recolouring_random_num_of_random_objs_random_cols_%s' % (i+1)
    setattr(RandomNumberOfRandomObjectsRandomlyRecolourTests
           ,method_name
           ,test_recolouring_random_num_of_random_objs_random_cols
           )
    method_names.append(method_name)
           
test_suite = unittest.TestSuite()
for method_name in method_names:
    test_suite.addTest(RandomNumberOfRandomObjectsRandomlyRecolourTests(method_name))
    
class MyComponent(component):
    def RunScript(self):
        return None, None
    
MyComponent = make_noninteractive_test_running_component_class(
                MyComponent,
                Grasshopper.Folders.DefaultUserObjectFolder,
                test_suite,
                )
# ---------- end run_tests_ghpython ----------
add_comp = Unload_sDNA()  # -> out, a
# ---------- add_comp: Python ----------
from ghpythonlib.componentbase import executingcomponent as component
import Grasshopper, GhPython
import System
import Rhino
import rhinoscriptsyntax as rs

class MyComponent(component):
    
    def RunScript(self, name):
        
        #        rnd = next(mem 
        #                   for mem in Rhino.NodeInCode.Components.NodeInCodeFunctions.GetDynamicMembers()
        #                   if mem.Name == 'Random')
        #        
        #        print(rnd)
        #        print(dir(rnd))
        #        print(rnd.FullName)
        #        print(rnd.FullScriptingName)
        #        print(rnd.ComponentGuid)
        #        
        #        return rnd

        comp_obj = Grasshopper.GUI.Gradient.GH_Gradient()
        
#        sizeF = System.Drawing.SizeF(-300, 500)
        
        
#        comp_obj.Attributes.Pivot = System.Drawing.PointF.Add(comp_obj.Attributes.Pivot, sizeF)
        GH_doc = ghdoc.Component.Attributes.DocObject.OnPingDocument()
        success = GH_doc.AddObject(docObject = comp_obj, update = False)

        return comp_obj
# ---------- end add_comp ----------
run_tests_ghpython_2 = Unload_sDNA()  # -> out, cols, geom
# ---------- run_tests_ghpython_2: Python ----------
#! /usr/bin/awk NR==3
# -*- coding: utf-8 -*-
# This module requires Grasshopper Python (Rhino3D)

# MIT License 

# Copyright (c) [2021] [Cardiff University, a body incorporated
# by Royal Charter and a registered charity (number:
# 1136855) whose administrative offices are at 7th floor 30-
# 36 Newport Road, University CF24 0DE, Wales, UK] 

# Permission is hereby granted, free of charge, to any person obtaining a copy
# of this software and associated documentation files (the "Software"), to deal
# in the Software without restriction, including without limitation the rights
# to use, copy, modify, merge, publish, distribute, sublicense, and/or sell
# copies of the Software, and to permit persons to whom the Software is
# furnished to do so, subject to the following conditions:

# The above copyright notice and this permission notice shall be included in all
# copies or substantial portions of the Software.

# THE SOFTWARE IS PROVIDED "AS IS", WITHOUT WARRANTY OF ANY KIND, EXPRESS OR
# IMPLIED, INCLUDING BUT NOT LIMITED TO THE WARRANTIES OF MERCHANTABILITY,
# FITNESS FOR A PARTICULAR PURPOSE AND NONINFRINGEMENT. IN NO EVENT SHALL THE
# AUTHORS OR COPYRIGHT HOLDERS BE LIABLE FOR ANY CLAIM, DAMAGES OR OTHER
# LIABILITY, WHETHER IN AN ACTION OF CONTRACT, TORT OR OTHERWISE, ARISING FROM,
# OUT OF OR IN CONNECTION WITH THE SOFTWARE OR THE USE OR OTHER DEALINGS IN THE
# SOFTWARE.
        

__author__ = 'James Parrott'
__version__ = '3.0.0.alpha_1'
        
        
        
        
import sys
import os
import functools
import importlib

from ghpythonlib.componentbase import executingcomponent as component
import Grasshopper
import scriptcontext as sc

import_module = importlib.import_module
try:
    reload #type: ignore
except NameError:
    reload = importlib.reload

try:
    basestring #type: ignore
except NameError:
    basestring = str

try:
    ghdoc #type: ignore
except NameError:
    from .custom.skel.basic.ghdoc import ghdoc


ZIP_FILE_NAME = 'sdna-gh'
PACKAGE_NAME = 'sDNA_GH'
PLUG_IN_NAME = 'sDNA'               
RELOAD_IF_ALREADY_IMPORTED = False
REPOSITORY = os.path.dirname(os.path.dirname(ghdoc.Path)) if ghdoc.Path else None
# Assume we are in repo_folder/dev/sDNA_build_components.gh

USER_INSTALLATION_FOLDER = os.path.join(
                                    Grasshopper.Folders.DefaultUserObjectFolder
                                   ,ZIP_FILE_NAME
                                   )
SELFTEST = 'selftest'




class Output(object): 

    def set_logger(self, logger, flush = True):
        self.logger = logger
        if flush and self.tmp_logs:
            self.flush()

    def __init__(self
                ,tmp_logs = None
                ,logger = None
                ):
        if not isinstance(tmp_logs, list): #assert not isinstance(None, list)
            tmp_logs = []
        self.tmp_logs = tmp_logs
        self.set_logger(logger, flush = False)



    def store(self, message, logging_level):
        self.tmp_logs.append( (message, logging_level) )

    def __call__(self, message, logging_level = "INFO", logging_dict = {}):
        #type: (str, str, dict, list) -> str
        
        #logger.debug(s)

        if logging_dict == {} and self.logger is not None: 
            logging_dict = dict( DEBUG = self.logger.debug
                                ,INFO = self.logger.info
                                ,WARNING = self.logger.warning
                                ,ERROR = self.logger.error
                                ,CRITICAL = self.logger.critical
                                )

        logging_level = logging_level.upper()
        if logging_level in logging_dict:
            logging_dict[logging_level](message)
        else:
            self.store(message, logging_level)

        return '%s : %s ' % (logging_level, message)

    def __getattr__(self, attr):
        return functools.partial(self.__call__, logging_level = attr.upper())

    def flush(self):
        tmp_logs = self.tmp_logs[:] # __call__ might cache back to tmp_logs
        self.tmp_logs[:] = [] # Mutate list initialised with.  Avoid double 
                              # logging in case re - stored in tmp_logs
        for tmp_log_message, tmp_log_level in tmp_logs:
            self.__call__(tmp_log_message, tmp_log_level)

output = Output()

class InvalidArgsError(Exception):
    
    """Custom exception to log the error message, and to at least allow 
       attempts to give users actionable advice to fix the issue, in 
       the event of a problem.  
    """
    message_fmt = 'Invalid import args: %s'
    def __init__(self
                ,message_fmt = ''
                ,message = ''
                ,logger = output
                , **kwargs
                ):
        if message_fmt and isinstance(message_fmt, basestring):
            self.message_fmt = message_fmt
        if kwargs and (not message or not isinstance(message, basestring)):
            message = self.message_fmt % kwargs
        logger.error(message)
        self.kwargs = kwargs
        super(InvalidArgsError, self).__init__(message)    


class ModuleNameError(InvalidArgsError):
    message_fmt = 'Invalid module name: %s'


class FilePathError(InvalidArgsError):
    message_fmt = 'Invalid path to import module from: %s'


# We only know the sDNA version to import as a string.  This is more secure too.
def strict_import(module_name = ''
                 ,folder = ''
                 ,sub_folder = ''
                 ,logger = output
                 ,reload_already_imported = RELOAD_IF_ALREADY_IMPORTED
                 ):

    # type: (str, str, str, type[any], bool) -> type[any]
    """ Imports the named module from the specified folder\subfolder only, 
        and returns it.
        
        Avoids name clashes and casual hijack attempts.  In some 
        environments supporting a Python implementation (such as 
        GhPython in Grasshopper) it may not be desirable to ask the user 
        to set PYTHONPATH.  Hence here, we insert the specified folder
        into sys.path (if they are not already in there).
    """
    if not module_name or not isinstance(module_name, basestring):
        raise ModuleNameError(module_name = module_name
                             ,folder = folder
                             ,sub_folder = sub_folder
                             ,logger = logger
                             )
    logger.debug(module_name)
    if module_name in sys.modules:   # sys.modules is also shared between GHPython components 
                                     # (and is even saved until Rhino is closed).
        logger.debug('Module %s already in sys.modules' % module_name)
        if reload_already_imported:
            logger.debug('Reloading %s.... ' % module_name)
            reload(sys.modules[module_name]) # type: ignore
        return sys.modules[module_name]
    #
    #
    # Load module_name for first time:
    #
    #
    search_path = os.path.join(folder, sub_folder) 

    if (search_path 
        and isinstance(search_path, basestring) 
        and os.path.isdir(search_path)):
        #
        logger.debug('Search path == %s' % search_path)
        #if search_folder_only:
        #    sys.path = [search_path]
        if search_path not in sys.path:
            sys.path.insert(0, search_path)
    else:
        raise FilePathError(module_name = module_name
                           ,search_path = search_path
                           ,logger = logger
                           )

    logger.debug('Trying import... ')
    module = import_module(module_name, '')           

    return module       


class ModulesNotFoundError(InvalidArgsError):
    message_fmt = 'Modules not found in any location %s'


def load_modules(m_names
                ,folders
                ,logger = output
                ,module_name_error_msg = 'Please supply valid names of modules to import, %s'
                ,folders_error_msg = 'Please supply valid folders to import from. %s'
                ,modules_not_found_msg = 'Specified modules not found in any folder, %s'):
    #type(str/ Iterable, list, type[any], str, str) -> tuple / None
    """ Tries to import all modules in m_names, from the first folder in 
        folders to contain a .py or .pyc files with the same name as each 
        module.

        Returns a tuple of all the modules and the path they were found in.  Else 
        raises a ModulesNotFoundError.
    """
    if not m_names:
        raise ModuleNameError(message_fmt = 'No module names supplied, m_names = %s'
                             ,m_names = m_names
                             ,logger = logger
                             )

    if any( not isinstance(m_name, basestring) for m_name in m_names ):
        # if m_names is a basestring, the error is not raised 
        raise ModuleNameError(message_fmt = module_name_error_msg
                             ,m_names = m_names
                             ,logger = logger
                             )
    
    if isinstance(m_names, basestring):
        m_names = [m_names] 

    logger.debug('m_names == %s of type : %s' % (m_names, type(m_names).__name__))

    logger.debug('Testing paths : %s ' % folders)
    
    if isinstance(folders, basestring):
        folders = [folders]

    if not any(os.path.isdir(folder) or os.path.isdir(os.path.dirname(folder)) 
               for folder in folders
              ):
        raise FilePathError(message_fmt = folders_error_msg
                           ,m_names = m_names
                           ,logger = logger
                           )

    for folder in folders:
        logger.debug('Type(folder) : %s' % type(folder).__name__)
        logger.debug('Type(path) : %s path == %s' %(type(folder).__name__, folder))

        if os.path.isfile(folder):
            folder = os.path.dirname(folder)
        if all( any(os.path.isfile(os.path.join(folder, name.replace('.', os.sep) + ending)) 
                    for ending in ['.py','.pyc'] 
                   )
                for name in m_names
              ):
            #
            logger.debug('Importing %s' % repr(m_names))

            return tuple(strict_import(name, folder, '', logger = logger) 
                         for name in m_names
                        ) + (folder,)
            # tuple of modules, followed by the path to them
    raise ModulesNotFoundError(message_fmt = modules_not_found_msg
                              ,m_names = m_names
                              ,folders = folders
                              ,logger = logger
                              )


sDNA_GH_search_path = USER_INSTALLATION_FOLDER

load_modules(  m_names = PACKAGE_NAME + '.main'
              ,folders = sDNA_GH_search_path
              ,folders_error_msg = 'Please unzip %s.zip '
                                   %ZIP_FILE_NAME
                                   +' in the folder %s '
                                   %Grasshopper.Folders.DefaultUserObjectFolder
                                   +'and ensure a subfolder called %s is created '
                                   %os.path.join(ZIP_FILE_NAME, PACKAGE_NAME)
                                   +'inside it, containing main.py ' 
                                   +'and all the sDNA_GH python files '
                                   +'including those within other subfolders. ' 
              ,modules_not_found_msg = 'Some sDNA_GH files may be missing.  '
                                      +'Please: 1) Copy %s.zip into: %s '
                                      %(ZIP_FILE_NAME
                                       ,Grasshopper.Folders.DefaultUserObjectFolder
                                       )
                                      +'2) Unblock it if necessary. '
                                      +'3) Right click '
                                      +'it, select Extract All... and click Extract, '
                                      +'to extract it to that location. '
                                      +'4) Ensure that main.py and all sDNA_GH python' 
                                      +' files and subfolders are inside: %s '
                                      %os.path.join(USER_INSTALLATION_FOLDER
                                                   ,PACKAGE_NAME
                                                   )
                                      +'5) Reinitialise the component or restart Rhino.'
              )         


load_modules('%s.tests.unit_tests.%s_unit_tests' % ((PACKAGE_NAME,)*2)
                            ,sDNA_GH_search_path
                            )

#! python2

import os 
import time
import random
import inspect
import logging
from collections import OrderedDict
import unittest

import System

import scriptcontext as sc 
import Rhino
import Rhino.NodeInCode.Components
import Grasshopper
import rhinoscriptsyntax as rs
import ghpythonlib.treehelpers as th
from ghpythonlib.componentbase import executingcomponent as component 

from sDNA_GH.tests.unit_tests.sDNA_GH_unit_tests import make_noninteractive_test_running_component_class


def GH_doc_components(doc):
    return {component.NickName : component
            for component in doc.Objects
           }

def set_data_on(param, val):
    param.ClearData()
    param.AddVolatileData(Grasshopper.Kernel.Data.GH_Path(0), 0, val)

def get_data_from(param):
    branch = Grasshopper.DataTree[object](param.VolatileData).Branch(0)
    return branch[0] if branch else None


GH_Doc = ghdoc.Component.Attributes.DocObject.OnPingDocument()
GH_Doc_components = GH_doc_components(GH_Doc)

#all_docs_comps = {
#    os.path.splitext(os.path.basename(doc.FilePath))[0] : (doc, GH_doc_components(doc)) 
#    for doc in Grasshopper.Instances.DocumentServer.GetEnumerator() 
#    }





#info = Rhino.NodeInCode.Components.FindComponent('read')

#assert info

import os
from collections import OrderedDict

import System 

import Grasshopper

def get_position(comp_number, row_width = 800, row_height = 175, pos = (200, 550)):
    l = comp_number * row_height
    x = pos[0] + (l % row_width)
    y = pos[1] + 220 * (l // row_width)
    return x, y

GH_doc = ghdoc.Component.Attributes.Owner.OnPingDocument()
#

def get_plugin_files(plugin = ''):

    gh_comp_server = Grasshopper.Kernel.GH_ComponentServer()
    #print(list(gh_comp_server.FindObjects(guid)))

    return OrderedDict((os.path.splitext(file_.FileName)[0], file_)
                        for file_ in gh_comp_server.ExternalFiles(True, True)
                        if plugin.lower() in file_.FilePath.lower()
                       )
def add_instance_of_userobject_to_canvas(name, plugin_files = None, comp_number=1, pos = (200, 550)):
    
    plugin_files = plugin_files or get_plugin_files('sDNA_GH')
    
    file_obj = next((v
                     for k, v in plugin_files.items() 
                     if name.lower() in k.lower()
                    )
                    ,None)
                    
    if file_obj is None:
        raise Exception('No user object found called: %s' % name)
    
#    print(dir(file_obj))
#    print(file_obj.GetHashCode())
#    guid = file_obj.FileHash
#    print(guid)
                    
    user_obj = Grasshopper.Kernel.GH_UserObject(file_obj.FilePath)

    comp_obj = user_obj.InstantiateObject()
    
    comp_obj.Locked = False
    
    
    
    sizeF = System.Drawing.SizeF(*get_position(comp_number, pos=pos))
    
    
    comp_obj.Attributes.Pivot = System.Drawing.PointF.Add(comp_obj.Attributes.Pivot, sizeF)
    
    success = GH_doc.AddObject(docObject = comp_obj, update = False)
    
    if not success:
        raise Exception('Could not add comp: %s to GH canvas' % comp_obj)
    
    return comp_obj 


if 'Recolour_Objects' not in GH_Doc_components:
    Recolour_Objects = add_instance_of_userobject_to_canvas('Recolour_Objects')
else:
    Recolour_Objects = GH_Doc_components['Recolour_Objects']
    

# print(type(Recolour_Objects))

def run_comp(comp, **kwargs):
    
    comp.ClearData()
    #    comp.ExpireSolution(False)
    for param in comp.Params.Input:
        if param.NickName in kwargs:
            set_data_on(param, kwargs[param.NickName])
    comp.CollectData()
    comp.ComputeData()
    
    return {param.NickName : get_data_from(param) 
            for param in comp.Params.Output
           }

#def run_Recolour_Objects(Data, Geom):
#    set_data_on(Recolour_Objects.Params.Input[0], True) #go
#    set_data_on(Recolour_Objects.Params.Input[4], Data) 
#    set_data_on(Recolour_Objects.Params.Input[5], Geom)

#    run_comp(Recolour_Objects, go=True, Data=Data, Geom=Geom)

    # a = get_data_from(Recolour_Objects.Params.Output[0])

    # print(a)


# cols = th.tree_to_list(colours)[0]

# print(len(cols[0]))

# random is used here for fuzz testing, not Cryptography.  
# But could Windows OS generated randomness be repeatable
# between instances of the same VM image, e.g. CI runners?  
# If so use:
# random.seed(time.time())
# Otherwise, assuming os.urandom includes the time already:
SEED = os.urandom(10)
random.seed(SEED)

# Extents of viewport
MIN_X, MAX_X, MIN_Y, MAX_Y = -10.0, 110.0, -10.0, 40.0

def random_number(min_ = MIN_X, max_ = MAX_X):
    return random.uniform(min_, max_)

def random_pair():
    return random_number(), random_number()

def random_triple():
    return random_pair() + (random_number(),)

def random_int(min_ = 2, max_ = 17):
    return random.randint(min_, max_)

def random_triples(n = None):
    n = n or random_int(min_ = 3)
    return tuple(random_triple() for __ in range(n))

# def random_point():

def random_nurbs_curve(length = None, degree = None):
    length = length or random_int()

    # The control points are a list of at least degree+1 points.
    # https://developer.rhino3d.com/guides/opennurbs/nurbs-geometry-overview/
    degree = degree or random_int(1, length-1)

    # The knots are a list of degree+N-1 numbers, where N is the number of control points. Sometimes this list of numbers is called the knot vector. In this term, the word vector does not mean 3‑D direction.
    # This list of knot numbers must satisfy several technical conditions. The standard way to ensure that the technical conditions are satisfied is to require the numbers to stay the same or get larger as you go down the list and to limit the number of duplicate values to no more than the degree. For example, for a degree 3 NURBS curve with 11 control points, the list of numbers 0,0,0,1,2,2,2,3,7,7,9,9,9 is a satisfactory list of knots. The list 0,0,0,1,2,2,2,2,7,7,9,9,9 is unacceptable because there are four 2s and four is larger than the degree.
    # The number of times a knot value is duplicated is called the knot’s multiplicity. In the preceding example of a satisfactory list of knots, the knot value 0 has multiplicity three, the knot value 1 has multiplicity one, the knot value 2 has multiplicity three, the knot value 3 has multiplicity one, the knot value 7 has multiplicity two, and the knot value 9 has multiplicity three. A knot value is said to be a full-multiplicity knot if it is duplicated degree many times. In the example, the knot values 0, 2, and 9 have full multiplicity. A knot value that appears only once is called a simple knot. In the example, the knot values 1 and 3 are simple knots.
    # If a list of knots starts with a full multiplicity knot, is followed by simple knots, terminates with a full multiplicity knot, and the values are equally spaced, then the knots are called uniform. For example, if a degree 3 NURBS curve with 7 control points has knots 0,0,0,1,2,3,4,4,4, then the curve has uniform knots. The knots 0,0,0,1,2,5,6,6,6 are not uniform. Knots that are not uniform are called non‑uniform. The N and U in NURBS stand for non‑uniform and indicate that the knots in a NURBS curve are permitted to be non-uniform.
    # Duplicate knot values in the middle of the knot list make a NURBS curve less smooth. At the extreme, a full multiplicity knot in the middle of the knot list means there is a place on the NURBS curve that can be bent into a sharp kink. For this reason, some designers like to add and remove knots and then adjust control points to make curves have smoother or kinkier shapes. Since the number of knots is equal to (N+degree‑1), where N is the number of control points, adding knots also adds control points and removing knots removes control points. Knots can be added without changing the shape of a NURBS curve. In general, removing knots will change the shape of a curve.
    knots = []

    i = 0
    while len(knots) < degree + length -1:
        multiplicity = random_int(1, degree)
        knots.extend([i,] * multiplicity)
        i += 1

    #
    points = random_triples(length)

    return rs.AddNurbsCurve(points, knots, degree) 

try:
    unichr
except NameError:
    unichr = chr

def random_string(length = None):
    length = length or random_int()
    return u''.join(unichr(random_int()) for __ in range(length))


OBJECT_GENERATORS = [rs.AddArc3Pt, rs.AddBox, rs.AddCircle3Pt, 
                     rs.AddCone, rs.AddCurve, rs.AddEllipse3Pt, rs.AddLine,
                     rs.AddPoint, rs.AddPolyline,
                     rs.AddRectangle, rs.AddSphere, rs.AddSpiral, rs.AddTorus,
                     rs.AddTextDot, random_nurbs_curve
                     ]

def needed_args(func):
    arg_spec = inspect.getargspec(func)
    if arg_spec.defaults is None:
        return arg_spec.args
    return arg_spec.args[:-len(arg_spec.defaults)]

#for obj_gen in OBJECT_GENERATORS:
#    break
#    print('%s: %s' % (obj_gen.__name__, needed_args(obj_gen)))

random_funcs = OrderedDict([
                     (('start', 'end', 'first', 'second', 'third', 'center'), random_triple),
                     (('points','corners'), random_triples),
                     (('point', ), random_triple),
                     (('plane','base'), lambda : rs.WorldXYPlane()),
                     (('height', 'width', 'radius', 'pitch'), random_number),
                     (('turns',), random_int),
                     (('text',), random_string),
                     ])


def random_Geometry():

    N = random_int(1, 14)

    Geom = []
    for __ in range(N):
        obj_gen = random.choice(OBJECT_GENERATORS)
        kwargs = {}
        for arg in needed_args(obj_gen):
            names_and_random_funcs = ((name, v) 
                                    for k, v in random_funcs.items()
                                    for name in k)
            for name, random_func in names_and_random_funcs:
                if name in arg:
                    kwargs[arg] = random_func()
                    break
                #
            else: # no break in inner most for loop - no name found
                raise KeyError('No random func found for arg: %s' % arg)
        try:
            geom = obj_gen(**kwargs)        
        except Exception:
            print('Oops! %s ' % [obj_gen.__name__, kwargs])
            continue
        if geom:
            Geom.append(str(geom))
    
    return Geom

def make_callable_using_node_in_code(name):
    func_info = Rhino.NodeInCode.Components.FindComponent(name);
    
    #    if (func_info == null) { Print("Error finding function"); return; }
    
    func = func_info.Delegate #as dynamic;


#def make_random_objects_random_colours_tester():

def test_recolouring_random_num_of_random_objs_random_cols(self):

    sc.doc = Rhino.RhinoDoc.ActiveDoc
    Geom = random_Geometry()

    N = len(Geom)

    cols = []

    GHRandomComponent = GH_Doc_components['Random']
    GHGradientComponent = GH_Doc_components['Gradient']
#    print('Grad.NickName: %s ' % GHGradientComponent.NickName)
#    print('Grad.Name: %s ' % GHGradientComponent.Name)

#    print([(Output.NickName, Output.Name) 
#           for Output in GHGradientComponent.Params.Output
#          ])


    # func = make_callable_using_node_in_code(name)
    
    for __ in range(N):

        #
#        I = [-123, 173, random_int(-123, 173)];
        #
#        result = func(*I);
        #
#        a = result[0]; #//this is output R
        
#        print(type(a))
        
#        cols.append(a)

#         randomise seed
#        set_data_on(GHRandomComponent.Params.Input[2], random_int())
#        set_data_on(GHRandomComponent.Params.Input[1], 1)

        random_retvals = run_comp(GHRandomComponent, N=1, S = random_int(0, 250000))

        gradient_retvals = run_comp(GHGradientComponent, L0=-123, L1 = 172, t = random_retvals['nums'])


        # print()
#        col = get_data_from(GHGradientComponent.Params.Output[0])
        col = gradient_retvals['C']
        cols.append(col.Value) #System.Drawing.Color(col))


    # print([dir(col.Value) for col in cols])
    # print([col.Value for col in cols])
    # print([isinstance(col.Value, System.Drawing.Color) for col in cols])
    # print([type(col.Value) for col in cols])
    # print([type(geom) for geom in Geom])

    # sc.doc = ghdoc
    # print()

    # cols = th.list_to_tree(cols)

    run_comp(Recolour_Objects, go=True, Data=cols, Geom=Geom)

    j = 0
    for geom, colour in zip(Geom, cols):
        guid = System.Guid(geom)
        j += 1
        if not guid:
            print('j: %s, Falsey guid: %s' % (j, guid))
            continue
        obj = Rhino.RhinoDoc.ActiveDoc.Objects.Find(guid)
        if not obj:
            print('j: %s, Falsey obj: %s' % (j, obj))
            continue
        if self is not None:
            self.assertEqual(obj.Attributes.ObjectColor, colour)
        print('%s: Correct colour: %s' % (guid, obj.Attributes.ObjectColor == colour))
      

class RandomNumberOfRandomObjectsRandomlyRecolourTests(unittest.TestCase):
    pass


NUM_TESTS = 5

method_names = []

for i in range(NUM_TESTS):
#    test_recolouring_random_num_of_random_objs_random_cols(None)
    method_name = 'test_recolouring_random_num_of_random_objs_random_cols_%s' % (i+1)
    setattr(RandomNumberOfRandomObjectsRandomlyRecolourTests
           ,method_name
           ,test_recolouring_random_num_of_random_objs_random_cols
           )
    method_names.append(method_name)
           
test_suite = unittest.TestSuite()
for method_name in method_names:
    test_suite.addTest(RandomNumberOfRandomObjectsRandomlyRecolourTests(method_name))
    
class MyComponent(component):
    def RunScript(self):
        return None, None
    
MyComponent = make_noninteractive_test_running_component_class(
                MyComponent,
                Grasshopper.Folders.DefaultUserObjectFolder,
                test_suite,
                )
# ---------- end run_tests_ghpython_2 ----------

# ---- group: Test runner (includes full fixture).
run_tests_ipy2 = IronPython2Script(go=Toggle(False))  # -> out, cols, Geom; disabled
# ---------- run_tests_ipy2: IronPython ----------
#! python2

import os 
import time
import random
import inspect
import logging
from collections import OrderedDict

import System

import scriptcontext as sc 
import Rhino
import Grasshopper
import rhinoscriptsyntax as rs
import ghpythonlib.treehelpers as th

import sDNA_GH


def GH_doc_components(doc):
    return {component.NickName : component
            for component in doc.Objects
            }

def set_data_on(param, val):
    param.ClearData()
    param.AddVolatileData(Grasshopper.Kernel.Data.GH_Path(0), 0, val)

def get_data_from(param):
    return Grasshopper.DataTree[object](param.VolatileData).Branch(0)[0]


GH_Doc = ghdoc.Component.Attributes.DocObject.OnPingDocument()
GH_Doc_components = GH_doc_components(GH_Doc)

all_docs_comps = {
    os.path.splitext(os.path.basename(doc.FilePath))[0] : (doc, GH_doc_components(doc)) 
    for doc in Grasshopper.Instances.DocumentServer.GetEnumerator()
    }





comp_name_to_test =  'Recolour_Objects'




comp_to_test = GH_Doc_components[comp_name_to_test] 

# print(type(comp_to_test))

def run_comp(comp):
    
    comp.ExpireSolution(False)
    comp.CollectData()
    comp.ComputeData()

def run_Recolour_Objects(Data, Geom):
    set_data_on(comp_to_test.Params.Input[0], True) #go
    set_data_on(comp_to_test.Params.Input[4], Data) 
    set_data_on(comp_to_test.Params.Input[5], Geom)

    run_comp(comp_to_test)

    # a = get_data_from(comp_to_test.Params.Output[0])

    # print(a)


# cols = th.tree_to_list(colours)[0]

# print(len(cols[0]))

# random is used here for fuzz testing, not Cryptography.  
# But could Windows OS generated randomness be repeatable
# between instances of the same VM image, e.g. CI runners?  
# If so use:
# random.seed(time.time())
# Otherwise, assuming os.urandom includes the time already:
SEED = os.urandom(10)
random.seed(SEED)

# Extents of viewport
MIN_X, MAX_X, MIN_Y, MAX_Y = -10.0, 110.0, -10.0, 40.0

def random_number(min_ = MIN_X, max_ = MAX_X):
    return random.uniform(min_, max_)

def random_pair():
    return random_number(), random_number()

def random_triple():
    return random_pair() + (random_number(),)

def random_int(min_ = 2, max_ = 17):
    return random.randint(min_, max_)

def random_triples(n = None):
    n = n or random_int(min_ = 3)
    return tuple(random_triple() for __ in range(n))

# def random_point():

def random_nurbs_curve(length = None, degree = None):
    length = length or random_int()

    # The control points are a list of at least degree+1 points.
    # https://developer.rhino3d.com/guides/opennurbs/nurbs-geometry-overview/
    degree = degree or random_int(1, length-1)

    # The knots are a list of degree+N-1 numbers, where N is the number of control points. Sometimes this list of numbers is called the knot vector. In this term, the word vector does not mean 3‑D direction.
    # This list of knot numbers must satisfy several technical conditions. The standard way to ensure that the technical conditions are satisfied is to require the numbers to stay the same or get larger as you go down the list and to limit the number of duplicate values to no more than the degree. For example, for a degree 3 NURBS curve with 11 control points, the list of numbers 0,0,0,1,2,2,2,3,7,7,9,9,9 is a satisfactory list of knots. The list 0,0,0,1,2,2,2,2,7,7,9,9,9 is unacceptable because there are four 2s and four is larger than the degree.
    # The number of times a knot value is duplicated is called the knot’s multiplicity. In the preceding example of a satisfactory list of knots, the knot value 0 has multiplicity three, the knot value 1 has multiplicity one, the knot value 2 has multiplicity three, the knot value 3 has multiplicity one, the knot value 7 has multiplicity two, and the knot value 9 has multiplicity three. A knot value is said to be a full-multiplicity knot if it is duplicated degree many times. In the example, the knot values 0, 2, and 9 have full multiplicity. A knot value that appears only once is called a simple knot. In the example, the knot values 1 and 3 are simple knots.
    # If a list of knots starts with a full multiplicity knot, is followed by simple knots, terminates with a full multiplicity knot, and the values are equally spaced, then the knots are called uniform. For example, if a degree 3 NURBS curve with 7 control points has knots 0,0,0,1,2,3,4,4,4, then the curve has uniform knots. The knots 0,0,0,1,2,5,6,6,6 are not uniform. Knots that are not uniform are called non‑uniform. The N and U in NURBS stand for non‑uniform and indicate that the knots in a NURBS curve are permitted to be non-uniform.
    # Duplicate knot values in the middle of the knot list make a NURBS curve less smooth. At the extreme, a full multiplicity knot in the middle of the knot list means there is a place on the NURBS curve that can be bent into a sharp kink. For this reason, some designers like to add and remove knots and then adjust control points to make curves have smoother or kinkier shapes. Since the number of knots is equal to (N+degree‑1), where N is the number of control points, adding knots also adds control points and removing knots removes control points. Knots can be added without changing the shape of a NURBS curve. In general, removing knots will change the shape of a curve.
    knots = []

    i = 0
    while len(knots) < degree + length -1:
        multiplicity = random_int(1, degree)
        knots.extend([i,] * multiplicity)
        i += 1

    #
    points = random_triples(length)

    return rs.AddNurbsCurve(points, knots, degree) 

try:
    unichr
except NameError:
    unichr = chr

def random_string(length = None):
    length = length or random_int()
    return u''.join(unichr(random_int()) for __ in range(length))


OBJECT_GENERATORS = [rs.AddArc3Pt, rs.AddBox, rs.AddCircle3Pt, 
                     rs.AddCone, rs.AddCurve, rs.AddEllipse3Pt, rs.AddLine,
                     rs.AddPoint, rs.AddPolyline,
                     rs.AddRectangle, rs.AddSphere, rs.AddSpiral, rs.AddTorus,
                     rs.AddTextDot, random_nurbs_curve
                     ]

def needed_args(func):
    arg_spec = inspect.getargspec(func)
    if arg_spec.defaults is None:
        return arg_spec.args
    return arg_spec.args[:-len(arg_spec.defaults)]

for obj_gen in OBJECT_GENERATORS:
    break
    print('%s: %s' % (obj_gen.__name__, needed_args(obj_gen)))

random_funcs = OrderedDict([
                     (('start', 'end', 'first', 'second', 'third', 'center'), random_triple),
                     (('points','corners'), random_triples),
                     (('point', ), random_triple),
                     (('plane','base'), lambda : rs.WorldXYPlane()),
                     (('height', 'width', 'radius', 'pitch'), random_number),
                     (('turns',), random_int),
                     (('text',), random_string),
                     ])


def random_Geometry():

    Geom = []

    for obj_gen in OBJECT_GENERATORS:
        kwargs = {}
        for arg in needed_args(obj_gen):
            names_and_random_funcs = ((name, v) 
                                    for k, v in random_funcs.items()
                                    for name in k)
            for name, random_func in names_and_random_funcs:
                if name in arg:
                    kwargs[arg] = random_func()
                    break
                #
            else: # no break in inner most for loop - no name found
                raise KeyError('No random func found for arg: %s' % arg)
        try:
            geom = obj_gen(**kwargs)        
        except Exception:
            print('Oops! %s ' % [obj_gen.__name__, kwargs])
            continue
        if geom:
            Geom.append(str(geom))
        # break
    return Geom

# print(unichr(0xFFFF))

if go:

    sc.doc = Rhino.RhinoDoc.ActiveDoc
    Geom = random_Geometry()

    N = len(Geom)

    cols = []

    GHRandomComponent = GH_Doc_components['Random']
    GHGradientComponent = GH_Doc_components['Gradient']

    # print(GHGradientComponent.Params.Output)

    for __ in range(N):

        # randomise seed
        set_data_on(GHRandomComponent.Params.Input[2], random_int())
        set_data_on(GHRandomComponent.Params.Input[1], 1)

        run_comp(GHRandomComponent)

        run_comp(GHGradientComponent)


        # print()
        col = get_data_from(GHGradientComponent.Params.Output[0])
        cols.append(col.Value) #System.Drawing.Color(col))


    # print([dir(col.Value) for col in cols])
    # print([col.Value for col in cols])
    # print([isinstance(col.Value, System.Drawing.Color) for col in cols])
    # print([type(col.Value) for col in cols])
    # print([type(geom) for geom in Geom])

    # sc.doc = ghdoc
    # print()

    # cols = th.list_to_tree(cols)

    run_Recolour_Objects(cols, Geom)

    j = 0
    for geom, colour in zip(Geom, cols):
        guid = System.Guid(geom)
        j += 1
        if not guid:
            print(j)
            continue
        obj = Rhino.RhinoDoc.ActiveDoc.Objects.Find(guid)
        if not obj:
            print(j)
            continue
        print('%s: Correct colour: %s' % (guid, obj.Attributes.ObjectColor == colour))
# ---------- end run_tests_ipy2 ----------
panel = Panel(run_tests_ghpython_2.out)

# ----
panel_2 = Panel(add_comp.out)
